# Grasshopper definition Specularia_3Channel_DLI.gh (Grasshopper 1.0.7)
# plug-ins: LadybugGrasshopper, Spectral Materials, 3-channel PAR, 3-channel ePAR, Spectral Sky

# ----
# 4. Simulation Parameters
# 4.1 HB/LB Checks
# 4.2 Set Working Dir
# 4.3 Set Radiance parameters
sim_type = Slider(0, range=0..2)
radiance_ab = Slider(2, range=0..10)
rad_quality = Slider(1, range=0..2)
radiance_ad = Slider(1024, range=1..10000)
radiance_as = Slider(500, range=0..1000)
radiance_ar = Slider(100, range=0..1000)
radiance_aa = Slider(0.1, range=0..1)
honeybee = Honeybee_Honeybee()  # -> out; plug-in component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
ladybug = Ladybug_Ladybug()  # -> out; plug-in component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
radparameters = Honeybee_RADParameters(
    quality=rad_quality,
    ab=radiance_ab,
    ad=radiance_ad,
    as=radiance_as,
    ar=radiance_ar,
    aa=radiance_aa,
    additionalP="-lw 0.0001")  # -> readMe, radParameters; plug-in component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
working_directory_c_specularia_temp = Text("C:\specularia")
specularia_filename = Panel("test_3")
radiance_filename = Panel("radiance_3c")

# ----
# 3. Material Parameters
# 3.1 For each material in your scene, set up:
# 
# - Material type (0 for glass, 1 for plastic)
# - Path to the usr/txt file containing the spectral caracteristics
# (transmission/reflection) of the material
# - Wavelength interval of the SPD used for the simulation
# - Material roughness
# - Material specularity
# - Assign each layer in Rhino to the
# corresponding elements, then type
# the exact layer name into the "Pipeline"
# box preceded by an asterisk.
specularity_of_material = Slider(0, range=0..1)
rhino_layer_id_of_material = Slider(0, range=0..20)
material_type = Slider(1, range=0..1)
wavelength_interval_in_spectral_characte = Slider(10, range=0..10)  # "Wavelength interval in spectral characteristics file"
roughness_of_material = Slider(0.2, range=0..1)
specularity_of_material_2 = Slider(0, range=0..1)
rhino_layer_id_of_material_2 = Slider(2, range=0..20)
material_type_2 = Slider(0, range=0..1)
filepath = FilePath()
wavelength_interval_in_spectral_characte_2 = Slider(10, range=0..10)  # "Wavelength interval in spectral characteristics file"
roughness_of_material_2 = Slider(0, range=0..1)
path_to_spectral_characteristics_file = FilePath()
panel = Panel(filepath)
panel_2 = Panel(path_to_spectral_characteristics_file)
layers = GhPythonScript()  # -> name
# ---------- layers: Python ----------
import rhinoscriptsyntax as rs
import scriptcontext as sc
import Rhino as rh
import GhPython as gp

sc.doc = rh.RhinoDoc.ActiveDoc
layers = rs.LayerNames()
for e in layers:
    print e
# ---------- end layers ----------
pipeline = GeometryPipeline(
    GroupByLayer=False,
    GroupByType=False,
    IncludeHidden=True,
    IncludeLocked=True,
    LayerFilter="*envelope",
    NameFilter="*",
    SublayerFiltering=True,
    TypeFilter=1073741848)
pipeline_2 = GeometryPipeline(
    GroupByLayer=False,
    GroupByType=False,
    IncludeHidden=True,
    IncludeLocked=True,
    LayerFilter="*ground",
    NameFilter="*",
    SublayerFiltering=True,
    TypeFilter=1073741848)
panel_3 = Panel(layers)
item = ListItem(List=panel_3, Index=rhino_layer_id_of_material_2, Wrap=True)
item_2 = ListItem(List=panel_3, Index=rhino_layer_id_of_material, Wrap=True)
panel_4 = Panel(item_2)
panel_5 = Panel(item)

# ----
# 2. Daylight Parameters
# 2.1 Set the point in time you want to simulate (month, day, and hour).
# 2.2 EPW or Manual Overwrite
# 
# a) either input a weather file (RECOMMENDED)
# or manually overwrite based on your own input parameters (ADVANCED)
# b) or switch the "Overwrite the epw file data" to TRUE and set up the
# Direct Normal Irradiance (DNI), Diffuse Horizontal Irradiance (DHI),
# and Dew Point Temperature (Td) of the sky under which you want
# to simulate.
# 2.3. SPD & Wavelength
# 
# Select the desired color temperature for the spectral power distribution
# (SPD) of the sky, or input a custom SPD.
# Make sure the wavelengths match the
# wavelength interval of your custom SPD.
overwrite_epw_file_data = BooleanToggle(False)
month = Slider(6, range=1..12)
day = Slider(21, range=1..31)
hour = Slider(12, range=0..23.9)
dni_w_m2 = Slider(0, range=0..1000)
dhi_w_m2 = Slider(0, range=0..1000)
td_c = Slider(0, range=-50..50)
latitude = Slider(46.25, range=-90..90)
longitude = Slider(6.13, range=-90..90)
time_zone = Slider(1, range=0..10)
weather_file_epw = FilePath()
daylight = ValueList({"5000K": 0, "6500K": 1, "9000K": 2, "Custom": 3}, selected="6500K")
wavelengths = Text(["380", "381", "382", "383", "384", "385", "386", "387", "388", "389"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])
panel_6 = Panel(weather_file_epw)
cluster = Cluster(gate=daylight)

# ----
# 1. Sensor Arrangment
# 1.1 Individual, view-based sensor vs grid-based
# with a single view direction.
# 
# For individual sensor points, proceed to next step. To
# set up a grid-based sensor array, skip to step 1.3.
# 1.2 If you selected individual sensor(s), set up the point at which the
# sensor should be located in "Location point" and the point at which
# the sensor should look towards in "Direction point".
# 1.3 For grid-based analysis, set a surface on which the sensors should be located.
location_point = Point(Point(12.5, 0, 0))
direction_point = Point(Point(12.5, 50, 0))
analysis_surface = Surface(<surface referenced from the Rhino model>)
unit_z = UnitZ(Factor=1)
sensor_spacing = Slider(2, range=0..2)
sensor_height = Slider(0, range=0..3)
# INPUTS
# Establish input paramaters before running simulation
sensor_s = ValueList({"individual sensor(s)": 0, "sensor grid": 1}, selected="sensor grid")
vec2pt = Vector2Pt(PointA=location_point, PointB=direction_point, Unitize=False)  # -> Vector, Length
sensor_location = Point(location_point)
sensor_view_direction = Vector(vec2pt.Vector)
genmesh = Ladybug_GenerateMesh(testGeometry=analysis_surface, gridSize=sensor_spacing, distBaseSrf=sensor_height, moveTestMesh=True)  # -> readMe, simplify(testPoints), simplify(ptsVectors), simplify(facesArea), simplify(mesh); plug-in component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
lng = ListLength(List=genmesh.testPoints)
repeat = RepeatData(Data=unit_z, Length=lng)  # -> simplify(Data)
flip = FlipMatrix(Data=repeat)
sensor_locations = Point(flatten(genmesh.testPoints))
view_direction = Vector(flatten(flip))
location = StreamFilter(Gate=sensor_s, Stream0=sensor_location, Stream1=sensor_locations)
direction = StreamFilter(Gate=sensor_s, Stream0=sensor_view_direction, Stream1=view_direction)

# ----
# 7. Materials Definition
specularia_spectral_materials = SpeculariaSpectralMaterials(
    Spd_input=panel,
    Source_interval=wavelength_interval_in_spectral_characte_2,
    Excel_daylight_series_cal=False,
    Material_name=panel_4,
    Roughness=roughness_of_material_2,
    Specularity=specularity_of_material,
    Material_type=material_type_2,
    Channel_type=0)  # -> Current_dir, Channel_output, Mat_3, Mat_9a, Mat_9b, Mat_9c
specularia_spectral_materials_2 = SpeculariaSpectralMaterials(
    Spd_input=panel_2,
    Source_interval=wavelength_interval_in_spectral_characte,
    Excel_daylight_series_cal=False,
    Material_name=panel_5,
    Roughness=roughness_of_material,
    Specularity=specularity_of_material_2,
    Material_type=material_type,
    Channel_type=0)  # -> Current_dir, Channel_output, Mat_3, Mat_9a, Mat_9b, Mat_9c
create_directory = CreateSpeculariaDirectory(mat=specularia_spectral_materials_2.Mat_3)  # -> out, rad_def
# ---------- create_directory: Python ----------
# Create Directory
# Provided by Specularia 1.0
# Copyright 2023 Bryant Callahan, Mehlika Inanici, Ph.D. and Gundula Prosch (University of Washington) 
# Authored by Bryant Callahan & Dr. Mehlika Inanici 

# Adapated from Lark Spectral Lighting
# (v0.0.1-v1.0 Mehlika Inanici, Ph.D.,University of Washington/Marty Brennan, ZGF Architects LLP; v2.0 Clotilde Pierson, Ph.D., EPFL, Oregon State University/ Myrta Gkaintatzi-Masouti, M.Sc., Eindhoven University of Technology.

# Licensed under The Modified 3-Clause BSD License (the "License");
# You may obtain a copy of the License at
# https://opensource.org/licenses/BSD-3-Clause

"""
Use this component to create a directory for Specularia if none exists

    Inputs:
        mat: input from spectral materials output
    Output:
        rad_def: radiance definition
"""

ghenv.Component.Name = "Create Specularia Directory"
ghenv.Component.NickName = 'Create Directory'
ghenv.Component.Message = 'Specularia v1.0'
ghenv.Component.Category = "Specularia"
ghenv.Component.SubCategory = "Utilities"


import re
import os


#make Specularia directory if none exists
_path = 'C:\specularia\materials'
if os.path.isdir(_path) != True: 
    os.makedirs(_path)
else:
    pass

os.chdir(_path)
#print out current directory
current_dir = _path

material =  []
fopen = open(mat, 'r')
rad_def = fopen.read()
fopen.close()
# ---------- end create_directory ----------
create_directory_2 = CreateSpeculariaDirectory(mat=specularia_spectral_materials.Mat_3)  # -> out, rad_def; same code as create_directory
panel_7 = Panel(create_directory_2.rad_def)
panel_8 = Panel(create_directory.rad_def)
createhbsrfs = Honeybee_createHBSrfs(geometry=pipeline_2, RADMaterial=panel_8)  # -> readMe, simplify(HBSurface); plug-in component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
createhbsrfs_2 = Honeybee_createHBSrfs(geometry=pipeline, RADMaterial=panel_7)  # -> readMe, simplify(HBSurface); plug-in component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

# ----
# RUN
# Generate sky file, then
# run desired simulation
# *Note: DLI only works for
# grid-based simulations
# with an .epw file
generate_sky_file = LBFalseStartToggle(False)
run_point_in_time_par = LBFalseStartToggle(False)
calcuate_dli = LBFalseStartToggle(False)

# ----
# SETUP
# Once sensors, weather, and materials have
# been set, create the sky file and set directory
# 6. Sky Definition
importepw = Ladybug_ImportEpw(epwFile=weather_file_epw)  # -> readMe, latitude, location, dryBulbTemperature, dewPointTemperature, relativeHumidity, windSpeed, windDirection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; plug-in component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
strnum = Ladybug_SeparateData(inputList=flatten(importepw.diffuseHorizontalRadiation))  # -> numbers, strings; plug-in component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
explodelocation = Ladybug_DecomposeLocation(location=importepw.location)  # -> locationName, latitude, longitude, timeZone, elevation; plug-in component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
strnum_2 = Ladybug_SeparateData(inputList=flatten(importepw.directNormalRadiation))  # -> numbers, strings; plug-in component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
strnum_3 = Ladybug_SeparateData(inputList=flatten(importepw.dewPointTemperature))  # -> numbers, strings; plug-in component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
doy_hoy = Ladybug_DOY_HOY(days=day, months=month, hours=hour)  # -> HOY, DOY, date; plug-in component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
merge = Merge(Data1=graft(wavelengths), Data2=graft(cluster))
item_3 = ListItem(List=wavelengths, Index=1, Wrap=True)
item_4 = ListItem(List=wavelengths, Index=0, Wrap=True)
item_5 = ListItem(List=strnum_3.numbers, Index=doy_hoy.HOY, Wrap=True)
item_6 = ListItem(List=strnum_2.numbers, Index=doy_hoy.HOY, Wrap=True)
item_7 = ListItem(List=strnum.numbers, Index=doy_hoy.HOY, Wrap=True)
separator = Text(" ")
filter = StreamFilter(Gate=overwrite_epw_file_data, Stream0=explodelocation.latitude, Stream1=latitude)
filter_2 = StreamFilter(Gate=overwrite_epw_file_data, Stream0=explodelocation.longitude, Stream1=longitude)
filter_3 = StreamFilter(Gate=overwrite_epw_file_data, Stream0=explodelocation.timeZone, Stream1=time_zone)
filter_4 = StreamFilter(Gate=overwrite_epw_file_data, Stream0=item_5, Stream1=td_c)
filter_5 = StreamFilter(Gate=overwrite_epw_file_data, Stream0=item_6, Stream1=dni_w_m2)
filter_6 = StreamFilter(Gate=overwrite_epw_file_data, Stream0=item_7, Stream1=dhi_w_m2)
join = TextJoin(Text=merge, Join=separator)  # -> flatten(Result)
skyspd = Text("DiffuseSkySPD")
longitude_2 = Number(filter_2)
time_zone_2 = Number(filter_3)
latitude_2 = Number(filter)
dew_point_temperature = Number(filter_4)
normal_direct_irradiance = Number(filter_5)
horizontal_diffuse_irradiance = Number(filter_6)
generate_spd = GenerateSPDFile(folder=working_directory_c_specularia_temp, filename=skyspd, extension=2, data=join, write=generate_sky_file)  # -> out, file; inputs extension: Int32, data: list
# ---------- generate_spd: Python ----------
# Generate SPD File
# Provided by Specularia 1.0
# Copyright 2023 Bryant Callahan, Mehlika Inanici, Ph.D. and Gundula Prosch (University of Washington) 
# Authored by Bryant Callahan & Dr. Mehlika Inanici 

# Adapated from Lark Spectral Lighting
# (v0.0.1-v1.0 Mehlika Inanici, Ph.D.,University of Washington/Marty Brennan, ZGF Architects LLP; v2.0 Clotilde Pierson, Ph.D., EPFL, Oregon State University/ Myrta Gkaintatzi-Masouti, M.Sc., Eindhoven University of Technology.

# Licensed under The Modified 3-Clause BSD License (the "License");
# You may obtain a copy of the License at
# https://opensource.org/licenses/BSD-3-Clause

"""
Use this component to convert SPD values to a text file

    Inputs:
        folder: folder path
        filename: name of the file to write
        extension: [1 = .csv] [2 = .txt]
        data: data to write
        headings: optional column headings for data
        write: boolean toggle to run this component
    Output:
        file: file path
"""

ghenv.Component.Name = "Generate SPD File"
ghenv.Component.NickName = "Generate SPD"
ghenv.Component.Message = 'Specularia v1.0'
ghenv.Component.Category = "Specularia"
ghenv.Component.SubCategory = "Utilities"

import os
from Grasshopper.Kernel import GH_RuntimeMessageLevel as RML


#check all inputs
error_list = []
inputs = [folder, filename, extension, data, write]
inputs_name = ["folder", "filename", "extension", "data", "write"]

for idx, val in enumerate (inputs):
    if val == None or val == []:
        error_list.append(inputs_name[idx])

if len(error_list) != 0:
    check = "error"
else:
    check = 1

if check == "error":
    print "Warning! Connect the following inputs:" 
    print error_list


#write to file
if check != "error":
    
    #make directory if none exists
    if os.path.isdir(folder) != True: 
        os.makedirs(folder)
    else:
        pass
    
    if write == True:
        if folder and filename and data: 
            folder.replace("\\", "/")
            if extension == 1:
                file = folder + "\\" + filename + '.csv'
            elif extension == 2:
                file = folder + "\\" + filename + '.txt'
            
            f = open(file,"w")
            if headings:
                f.write(headings +'\n')
            for d in data:
                f.write(d + '\n')
            f.close()
# ---------- end generate_spd ----------
subtraction = Subtraction(A=item_3, B=item_4)
filename = Panel("par_base")
specularia_spectral_materials_3 = SpeculariaSpectralMaterials(
    Spd_input=generate_spd.file,
    Source_interval=subtraction,
    Excel_daylight_series_cal=False,
    Material_type=2,
    Channel_type=0)  # -> Current_dir, Channel_output, Mat_3, Mat_9a, Mat_9b, Mat_9c

specularia_spectral_sky = SpeculariaSpectralSky(
    Channel_output=specularia_spectral_materials_3.Channel_output,
    Channel_type=0,
    Latitude=latitude_2,
    Longitude=longitude_2,
    UTC=time_zone_2,
    Month=month,
    Day=day,
    Hour=hour,
    Normal_direct=normal_direct_irradiance,
    Horizontal_diffuse=horizontal_diffuse_irradiance,
    Temperature=dew_point_temperature,
    Name=filename)  # -> Current_dir, Sky_name_out, Sky_mat_3, Sky_mat_9a, Sky_mat_9b, Sky_mat_9c

gridbasedsimulation = Honeybee_GridBasedSimulation(
    skyFile=specularia_spectral_sky.Sky_mat_3,
    testPoints=location,
    ptsVectors=direction,
    simulationType=sim_type,
    radParameters=radparameters.radParameters)  # -> analysisRecipe; plug-in component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
rundaylightanalysis = Honeybee_RunDaylightSimulation(
    HBObjects=flatten([createhbsrfs.HBSurface, createhbsrfs_2.HBSurface]),
    analysisRecipe=gridbasedsimulation,
    writeRad=run_point_in_time_par,
    runRad=run_point_in_time_par,
    workingDir=working_directory_c_specularia_temp,
    radFileName=radiance_filename,
    overwriteResults=False)  # -> out, analysisType, resultsUnit, results, illuminance_values, resultFiles, illuminance_files, studyFolder, done; plug-in component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

# ----
# Moment in Time PAR (PPFD)
epar = Text("_ePAR")
par = Text("_PAR")
concatenate = Concatenate(FragmentA=specularia_filename, FragmentB=epar)
# Process & Visualize PAR/DLI
concatenate_2 = Concatenate(FragmentA=specularia_filename, FragmentB=par)
# RESULTS
par_curve = ValueList({"Standard PAR": FALSE, "Extended PAR": TRUE}, selected="Standard PAR")
specularia_3_channel_par = Specularia3ChannelPAR(Irradiance=rundaylightanalysis.resultFiles, RunPcomb=run_point_in_time_par, Directory=concatenate_2)  # -> Current_dir, Par_output, Photopic_lux
specularia_3_channel_epar = Specularia3ChannelEPAR(Irradiance=rundaylightanalysis.resultFiles, RunPcomb=run_point_in_time_par, Directory=concatenate)  # -> Current_dir, Par_output, Photopic_lux
colrange = LBColorRange(index=2)  # -> colors; plug-in component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
stream_filter = StreamFilter(Range=par_curve, Stream0=specularia_3_channel_par.Par_output, Stream1=specularia_3_channel_epar.Par_output)
mass_addition = MassAddition(Input=stream_filter)  # -> Result, PartialResults
legendpar = LBLegendParameters(colors=colrange)  # -> leg_par; plug-in component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
list_length = ListLength(List=sensor_locations)
par_2 = Panel(stream_filter)
division = Division(A=mass_addition.Result, B=list_length)
heatmap = LBSpatialHeatmap(values=flatten(stream_filter), mesh=genmesh.mesh, legend_par=legendpar)  # -> mesh, legend, title, colors, legend_par; plug-in component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
average_par = Panel(division)
tag = TextTag(Location=location, Text=flatten(stream_filter))

# ----
# Daily Light Integral (DLI)
_3_channel_dli = _3ChannelDLI(
    hb_objects=[createhbsrfs_2.HBSurface, createhbsrfs.HBSurface],
    testpoints=location,
    testvectors=direction,
    channeloutput=specularia_spectral_materials_3.Channel_output,
    latitude=latitude_2,
    longitude=longitude_2,
    utc=filter_3,
    month=month,
    day=day,
    normaldirect=strnum_2.numbers,
    horizontaldiffuse=strnum.numbers,
    temperature=strnum_3.numbers,
    radparameters=radparameters.radParameters,
    workingdir=working_directory_c_specularia_temp,
    radfilename=radiance_filename,
    speculariafilename=specularia_filename,
    runpcomb=calcuate_dli)  # -> out_2, par_ppfd_2, par_hourly_2, dli_2
min = Panel("0")
max = Panel("25")
dli_at_each_point = Panel(_3_channel_dli.dli_2)
legendpar_2 = LBLegendParameters(min=min, max=max, continuous_leg=True, num_decimals=0, seg_height=3.5)  # -> leg_par; plug-in component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
heatmap_2 = LBSpatialHeatmap(values=flatten(dli_at_each_point), mesh=genmesh.mesh, legend_par=legendpar_2)  # -> mesh, legend, title, colors, legend_par; plug-in component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
tag_2 = TextTag(Location=location, Text=flatten(dli_at_each_point))

# ==== cluster Cluster
custom = ClusterInput()
gate = ClusterInput()
_6500k = Text(["0.4298", "0.4332", "0.4366", "0.4399", "0.4433", "0.4467"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])
_9000k = Text(["0.5852", "0.5855", "0.5857", "0.586", "0.5863", "0.5865"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])
_5000k = Text(["0.234", "0.239", "0.245", "0.251", "0.256", "0.262"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])
custom_2 = Text(custom)
stream_filter = StreamFilter(Gate=gate, Stream0=_5000k, Stream1=_6500k, Stream2=_9000k, Stream3=custom_2)
ghpython_script = GhPythonScript(x="Specularia v1.0")  # -> a
# ---------- ghpython_script: Python ----------
d = ghenv.Component.OnPingDocument()
d.Owner.Message = str(x)
# ---------- end ghpython_script ----------
sky_spd = Text(stream_filter)
sky_spd_2 = ClusterOutput(sky_spd)

# ==== cluster _3ChannelDLI
speculariafilename = ClusterInput()
horizontaldiffuse = ClusterInput()
channeloutput = ClusterInput()
radparameters = ClusterInput()
normaldirect = ClusterInput()
temperature = ClusterInput()
radfilename = ClusterInput()
hb_objects = ClusterInput()
testvectors = ClusterInput()
workingdir = ClusterInput()
runpcomb = ClusterInput()
testpoints = ClusterInput()
longitude = ClusterInput()
latitude = ClusterInput()
utc = ClusterInput()
month = ClusterInput()
day = ClusterInput()
speculariafilename_2 = Text(speculariafilename)
horizontaldiffuse_2 = Number(horizontaldiffuse)
channeloutput_2 = Data(channeloutput)
radparameters_2 = Data(radparameters)
normaldirect_2 = Number(normaldirect)
temperature_2 = Number(temperature)
radfilename_2 = Text(radfilename)
hb_objects_2 = Geometry(hb_objects)
testvectors_2 = Vector(testvectors)
workingdir_2 = Text(workingdir)
runpcomb_2 = Boolean(runpcomb)
testpoints_2 = Point(testpoints)
longitude_2 = Number(longitude)
latitude_2 = Number(latitude)
utc_2 = Number(utc)
month_2 = Integer(month)
day_2 = Integer(day)
ghpython_script = GhPythonScript(x="Specularia v1.0")  # -> a; same code as ghpython_script
doy_hoy = Ladybug_DOY_HOY(days=day_2, months=month_2, hours=7)  # -> HOY, DOY, date; plug-in component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
addition = Addition(A=doy_hoy.HOY, B=1)
addition_2 = Addition(A=doy_hoy.HOY, B=2)
addition_3 = Addition(A=doy_hoy.HOY, B=3)
addition_4 = Addition(A=doy_hoy.HOY, B=4)
addition_5 = Addition(A=doy_hoy.HOY, B=5)
addition_6 = Addition(A=doy_hoy.HOY, B=6)
addition_7 = Addition(A=doy_hoy.HOY, B=7)
addition_8 = Addition(A=doy_hoy.HOY, B=8)
addition_9 = Addition(A=doy_hoy.HOY, B=9)
addition_10 = Addition(A=doy_hoy.HOY, B=10)
addition_11 = Addition(A=doy_hoy.HOY, B=11)
addition_12 = Addition(A=doy_hoy.HOY, B=12)
addition_13 = Addition(A=doy_hoy.HOY, B=13)
concatenate = Concatenate(RadianceFilename=radfilename_2, FragmentA="_", FragmentB="7")
concatenate_2 = Concatenate(FragmentA=radfilename_2, FragmentB="_", FragmentA_2="8")
concatenate_3 = Concatenate(FragmentA=radfilename_2, FragmentB="_", FragmentA_2="9")
concatenate_4 = Concatenate(FragmentA=radfilename_2, FragmentB="_", FragmentA_2="10")
concatenate_5 = Concatenate(FragmentA=radfilename_2, FragmentB="_", FragmentA_2="11")
concatenate_6 = Concatenate(FragmentA=radfilename_2, FragmentB="_", FragmentA_2="12")
concatenate_7 = Concatenate(FragmentA=radfilename_2, FragmentB="_", FragmentA_2="13")
concatenate_8 = Concatenate(FragmentA=radfilename_2, FragmentB="_", FragmentA_2="15")
concatenate_9 = Concatenate(FragmentA=radfilename_2, FragmentB="_", FragmentA_2="16")
concatenate_10 = Concatenate(FragmentA=radfilename_2, FragmentB="_", FragmentA_2="17")
concatenate_11 = Concatenate(FragmentA=radfilename_2, FragmentB="_", FragmentA_2="18")
concatenate_12 = Concatenate(FragmentA=radfilename_2, FragmentB="_", FragmentA_2="19")
concatenate_13 = Concatenate(FragmentA=radfilename_2, FragmentB="_", FragmentA_2="20")
concatenate_14 = Concatenate(FragmentA=radfilename_2, FragmentB="_", FragmentA_2="14")
item = ListItem(List=normaldirect_2, Index=doy_hoy.HOY, Wrap=True)
item_2 = ListItem(List=horizontaldiffuse_2, Index=doy_hoy.HOY, Wrap=True)
item_3 = ListItem(List=temperature_2, Index=doy_hoy.HOY, Wrap=True)
item_4 = ListItem(List=normaldirect_2, Index=addition, Wrap=True)
item_5 = ListItem(List=horizontaldiffuse_2, Index=addition, Wrap=True)
item_6 = ListItem(List=temperature_2, Index=addition, Wrap=True)
item_7 = ListItem(List=normaldirect_2, Index=addition_2, Wrap=True)
item_8 = ListItem(List=horizontaldiffuse_2, Index=addition_2, Wrap=True)
item_9 = ListItem(List=temperature_2, Index=addition_2, Wrap=True)
item_10 = ListItem(List=normaldirect_2, Index=addition_3, Wrap=True)
item_11 = ListItem(List=horizontaldiffuse_2, Index=addition_3, Wrap=True)
item_12 = ListItem(List=temperature_2, Index=addition_3, Wrap=True)
item_13 = ListItem(List=normaldirect_2, Index=addition_4, Wrap=True)
item_14 = ListItem(List=horizontaldiffuse_2, Index=addition_4, Wrap=True)
item_15 = ListItem(List=temperature_2, Index=addition_4, Wrap=True)
item_16 = ListItem(List=normaldirect_2, Index=addition_5, Wrap=True)
item_17 = ListItem(List=horizontaldiffuse_2, Index=addition_5, Wrap=True)
item_18 = ListItem(List=temperature_2, Index=addition_5, Wrap=True)
item_19 = ListItem(List=normaldirect_2, Index=addition_6, Wrap=True)
item_20 = ListItem(List=horizontaldiffuse_2, Index=addition_6, Wrap=True)
item_21 = ListItem(List=temperature_2, Index=addition_6, Wrap=True)
item_22 = ListItem(List=normaldirect_2, Index=addition_7, Wrap=True)
item_23 = ListItem(List=horizontaldiffuse_2, Index=addition_7, Wrap=True)
item_24 = ListItem(List=temperature_2, Index=addition_7, Wrap=True)
item_25 = ListItem(List=normaldirect_2, Index=addition_8, Wrap=True)
item_26 = ListItem(List=horizontaldiffuse_2, Index=addition_8, Wrap=True)
item_27 = ListItem(List=temperature_2, Index=addition_8, Wrap=True)
item_28 = ListItem(List=normaldirect_2, Index=addition_9, Wrap=True)
item_29 = ListItem(List=horizontaldiffuse_2, Index=addition_9, Wrap=True)
item_30 = ListItem(List=temperature_2, Index=addition_9, Wrap=True)
item_31 = ListItem(List=normaldirect_2, Index=addition_10, Wrap=True)
item_32 = ListItem(List=horizontaldiffuse_2, Index=addition_10, Wrap=True)
item_33 = ListItem(List=temperature_2, Index=addition_10, Wrap=True)
item_34 = ListItem(List=normaldirect_2, Index=addition_11, Wrap=True)
item_35 = ListItem(List=horizontaldiffuse_2, Index=addition_11, Wrap=True)
item_36 = ListItem(List=temperature_2, Index=addition_11, Wrap=True)
item_37 = ListItem(List=normaldirect_2, Index=addition_12, Wrap=True)
item_38 = ListItem(List=horizontaldiffuse_2, Index=addition_12, Wrap=True)
item_39 = ListItem(List=temperature_2, Index=addition_12, Wrap=True)
item_40 = ListItem(List=normaldirect_2, Index=addition_13, Wrap=True)
item_41 = ListItem(List=horizontaldiffuse_2, Index=addition_13, Wrap=True)
item_42 = ListItem(List=temperature_2, Index=addition_13, Wrap=True)
spectral_sky = SpectralRadianceSkyDefinitions(
    channel_output=channeloutput_2,
    channel_type=0,
    latitude=latitude_2,
    longitude=longitude_2,
    UTC=utc_2,
    month=month_2,
    day=day_2,
    hour="7",
    normal_direct=item,
    horizontal_diffuse=item_2,
    temperature=item_3,
    name=concatenate)  # -> current_dir, sky_name_out, sky_mat_3, sky_mat_9a, sky_mat_9b, sky_mat_9c; inputs channel_output: list, channel_type: Int32, UTC: Int32, day: Int32
# ---------- spectral_sky: Python ----------
# Spectral Sky
# Provided by Specularia 1.0
# Copyright 2023 Bryant Callahan, Mehlika Inanici, Ph.D. and Gundula Prosch (University of Washington) 
# Authored by Bryant Callahan & Dr. Mehlika Inanici 

# Adapated from Lark Spectral Lighting 
# (v0.0.1-v1.0 Mehlika Inanici, Ph.D.,University of Washington/Marty Brennan, ZGF Architects LLP; v2.0 Clotilde Pierson, Ph.D., EPFL, Oregon State University/ Myrta Gkaintatzi-Masouti, M.Sc., Eindhoven University of Technology.

# Licensed under The Modified 3-Clause BSD License (the "License");
# You may obtain a copy of the License at
# https://opensource.org/licenses/BSD-3-Clause

"""
Use this component to build 3- or 9-channel Radiance sky definitions.

    Args:
        channel_output: use the Speculara Spectral Materials component to write 3 or 9 spectral channels 
        channel_type: Choose [0 = 3 channel]  [1 = 9 channel]
        latitude: north of the equator is positive  
        longitude: west of the Prime Meridian is positive
        UTC:Coordinated Universal Time
        month: integer 1-12
        day: integer 1-31
        hour:float 1-24 (hour should not account for daylight saving time)
        normal_direct: normal direct irradiance
        horizontal_diffuse: float radiation from measurement
        temperature: dew point temperature
        name: optional name for sky spectrum (example: 10k_CCT)
    Returns:
        current_dir: current working folder 
        sky_name_out: Radiance sky definition name
        sky_mat_3: filepath for 3 channel sky definition
        sky_mat_9a: filepath for 9a channel sky definition
        sky_mat_9b: filepath for 9b channel sky definition
        sky_mat_9c: filepath for 9c channel sky definition
"""

ghenv.Component.Name = "Spectral Radiance Sky Definitions"
ghenv.Component.NickName = 'Spectral Sky'
ghenv.Component.Message = 'Specularia v1.0'
ghenv.Component.Category = "Specularia"
ghenv.Component.SubCategory = "Lighting"


#import libraries
import re
import os
from subprocess import Popen
import math
from collections import OrderedDict
from decimal import Decimal


#make specilaria directory if none exists
_path = 'C:\specularia\materials'
if os.path.isdir(_path) != True: 
    os.makedirs(_path)
else:
    pass
os.chdir(_path)
#print out current directory
current_dir = _path


#check all inputs
error_list = []
inputs = [channel_output,channel_type,latitude,longitude,UTC,month,day,hour,normal_direct,horizontal_diffuse,temperature]
inputs_name = ["channel_output","channel_type","latitude","longitude","UTC","month","day","hour","normal_direct","horizontal_diffuse","temperature"]

for idx, val in enumerate (inputs):
    if val == None or val == []:
        error_list.append(inputs_name[idx])

if len(error_list) != 0:
    check = "error"
else:
    check = 1

if check == "error":
    print "Warning! Connect the following inputs:" 
    print error_list
    print check


#assign sky name and process inputs
if name == None:        
    name = ""

if  check != "error":
    space = "_"
    sky_name = "%s%s%s%s%s%s" %(month,space,day,space,hour,name)
    sky_name_out = sky_name

    #convert to minutes
    UTC = int(UTC * -15) #positive west of primer meridian
    longitude = longitude * -1  #positive west of prime meridian


#photopic coefficients for each channel
v_b1 = .0004
v_b2 = .0095
v_b3 = .0522
v_g1 = .1288
v_g2 = .2231
v_g3 = .3175
v_r1 = .2521
v_r2 = .0162
v_r3 = .0002

v_r =  .2685
v_g =  .6694
v_b =  .0621


#prepare variables for sky definition
if  check != "error":
    direct = normal_direct

    if channel_type == 0:
        if len(channel_output) == 3:
            r,g,b = channel_output #assign channels
            sum3 = r*v_r + g*v_g + b*v_b  #multiply each channel by photopic coefficient (sum is less than 1.0)
            #the weighting of the sky model to account for the spectral calculation is done on the RGB components of the sky below so that it does not impact the result of the luminous efficacy model in gendaylit if done on the irradiance
            diffuse = horizontal_diffuse
        else:
            print "channel_output should equal 3 values"

    if channel_type == 1:
        if len(channel_output) == 9:
            b1,b2,b3,g1,g2,g3,r1,r2,r3 = channel_output  #assign channels
            sum9 = b1*v_b1 + b2*v_b2 + b3*v_b3 + g1*v_g1 + g2*v_g2 + g3*v_g3 + r1*v_r1 + r2*v_r2 + r3*v_r3 #multiply each channel by photopic coefficient (sum is less than 1.0)
            #the weighting of the sky model to account for the spectral calculation is done on the RGB components of the sky below so that it does not impact the result of the luminous efficacy model in gendaylit if done on the irradiance
            diffuse = horizontal_diffuse
        else:
            print "channel_output should equal 9 values"


#write Radiance sky definition
    gendaylit =  "%s %s %s %s %s %s %s %s %s %s %s %s %s %s %s \n" %("!gendaylit",month,day,hour,"-W",direct,diffuse,"-d",temperature,"-a",latitude,"-o",longitude,"-m",UTC)+ "\n"
    sky = "%s %s %s \n" %("sky_mat","source","sky") + ("0" + "\n")*2 + ("4" + "\n") + "%s %s %s %s" %(0,0,1,180) + "\n"*2
    ground_glow = "%s %s %s \n" %("skyfunc","glow","ground_glow") + ("0" + "\n")*2 + ("4" + "\n")+ "%s %s %s %s" %(1,1,1,0)+ "\n"*2
    ground = "%s %s %s \n" %("ground_glow","source","ground") + ("0" + "\n")*2 +("4" + "\n") +"%s %s %s %s" %(0,0,-1,180)
    sky_def = sky + ground_glow + ground + "\n" * 2


#write Radiance sky file
    if channel_type == 0:
        #the weighting of the sky model to account for the spectral calculation is done here on the RGB components of the sky so that it does not impact the result of the luminous efficacy model in gendaylit if done on the irradiance
        sky_mat =  "%s %s %s \n" %("skyfunc","glow","sky_mat") + ("0" + "\n")*2 +("4" + "\n") + "%s %s %s %s" %(round(r/sum3,2),round(g/sum3,2),round(b/sum3,2),0) + "\n" * 2
        material = open(sky_name+".rad", "w")
        material.write(gendaylit + sky_mat + sky_def)
        material.close()

    if channel_type == 1:
        #the weighting of the sky model to account for the spectral calculation is done here on the RGB components of the sky so that it does not impact the result of the luminous efficacy model in gendaylit if done on the irradiance
        sky_mat_a =  "%s %s %s \n" %("skyfunc","glow","sky_mat") + ("0" + "\n")*2 + ("4" + "\n") + "%s %s %s %s" %(round(b1/sum9,2),round(b2/sum9,2),round(b3/sum9,2),0) + "\n" * 2
        sky_mat_b =  "%s %s %s \n" %("skyfunc","glow","sky_mat") + ("0" + "\n")*2 + ("4" + "\n") + "%s %s %s %s" %(round(g1/sum9,2),round(g2/sum9,2),round(g3/sum9,2),0) + "\n" * 2
        sky_mat_c =  "%s %s %s \n" %("skyfunc","glow","sky_mat") + ("0" + "\n")*2 + ("4" + "\n") + "%s %s %s %s" %(round(r1/sum9,2),round(r2/sum9,2),round(r3/sum9,2),0) + "\n" * 2

        materiala = open(sky_name + "_a" +".rad", "w")
        materiala.write(gendaylit + sky_mat_a + sky_def)
        materiala.close()    

        materialb = open(sky_name + "_b" +".rad", "w")
        materialb.write(gendaylit + sky_mat_b + sky_def)
        materialb.close() 

        materialc = open(sky_name + "_c" +".rad", "w")
        materialc.write(gendaylit + sky_mat_c + sky_def)
        materialc.close() 


#print filepaths for rad sky
    sky_mat_3 = os.getcwd() + "\\" + sky_name+".rad"
    sky_mat_9a = os.getcwd() + "\\" + sky_name + "_a" +".rad"
    sky_mat_9b = os.getcwd() + "\\" + sky_name + "_b" +".rad"
    sky_mat_9c = os.getcwd() + "\\" + sky_name + "_c" +".rad"
# ---------- end spectral_sky ----------
spectral_sky_2 = SpectralRadianceSkyDefinitions(
    channel_output=channeloutput_2,
    channel_type=0,
    latitude=latitude_2,
    longitude=longitude_2,
    UTC=utc_2,
    month=month_2,
    day=day_2,
    hour="8",
    normal_direct=item_4,
    horizontal_diffuse=item_5,
    temperature=item_6,
    name=concatenate_2)  # -> current_dir, sky_name_out, sky_mat_3, sky_mat_9a, sky_mat_9b, sky_mat_9c; inputs channel_output: list, channel_type: Int32, UTC: Int32, day: Int32; same code as spectral_sky
spectral_sky_3 = SpectralRadianceSkyDefinitions(
    channel_output=channeloutput_2,
    channel_type=0,
    latitude=latitude_2,
    longitude=longitude_2,
    UTC=utc_2,
    month=month_2,
    day=day_2,
    hour="9",
    normal_direct=item_7,
    horizontal_diffuse=item_8,
    temperature=item_9,
    name=concatenate_3)  # -> current_dir, sky_name_out, sky_mat_3, sky_mat_9a, sky_mat_9b, sky_mat_9c; inputs channel_output: list, channel_type: Int32, UTC: Int32, day: Int32; same code as spectral_sky
spectral_sky_4 = SpectralRadianceSkyDefinitions(
    channel_output=channeloutput_2,
    channel_type=0,
    latitude=latitude_2,
    longitude=longitude_2,
    UTC=utc_2,
    month=month_2,
    day=day_2,
    hour="10",
    normal_direct=item_10,
    horizontal_diffuse=item_11,
    temperature=item_12,
    name=concatenate_4)  # -> current_dir, sky_name_out, sky_mat_3, sky_mat_9a, sky_mat_9b, sky_mat_9c; inputs channel_output: list, channel_type: Int32, UTC: Int32, day: Int32; same code as spectral_sky
spectral_sky_5 = SpectralRadianceSkyDefinitions(
    channel_output=channeloutput_2,
    channel_type=0,
    latitude=latitude_2,
    longitude=longitude_2,
    UTC=utc_2,
    month=month_2,
    day=day_2,
    hour="11",
    normal_direct=item_13,
    horizontal_diffuse=item_14,
    temperature=item_15,
    name=concatenate_5)  # -> current_dir, sky_name_out, sky_mat_3, sky_mat_9a, sky_mat_9b, sky_mat_9c; inputs channel_output: list, channel_type: Int32, UTC: Int32, day: Int32; same code as spectral_sky
spectral_sky_6 = SpectralRadianceSkyDefinitions(
    channel_output=channeloutput_2,
    channel_type=0,
    latitude=latitude_2,
    longitude=longitude_2,
    UTC=utc_2,
    month=month_2,
    day=day_2,
    hour="12",
    normal_direct=item_16,
    horizontal_diffuse=item_17,
    temperature=item_18,
    name=concatenate_6)  # -> current_dir, sky_name_out, sky_mat_3, sky_mat_9a, sky_mat_9b, sky_mat_9c; inputs channel_output: list, channel_type: Int32, UTC: Int32, day: Int32; same code as spectral_sky
spectral_sky_7 = SpectralRadianceSkyDefinitions(
    channel_output=channeloutput_2,
    channel_type=0,
    latitude=latitude_2,
    longitude=longitude_2,
    UTC=utc_2,
    month=month_2,
    day=day_2,
    hour="13",
    normal_direct=item_19,
    horizontal_diffuse=item_20,
    temperature=item_21,
    name=concatenate_7)  # -> current_dir, sky_name_out, sky_mat_3, sky_mat_9a, sky_mat_9b, sky_mat_9c; inputs channel_output: list, channel_type: Int32, UTC: Int32, day: Int32; same code as spectral_sky
spectral_sky_8 = SpectralRadianceSkyDefinitions(
    channel_output=channeloutput_2,
    channel_type=0,
    latitude=latitude_2,
    longitude=longitude_2,
    UTC=utc_2,
    month=month_2,
    day=day_2,
    hour="14",
    normal_direct=item_22,
    horizontal_diffuse=item_23,
    temperature=item_24,
    name=concatenate_14)  # -> current_dir, sky_name_out, sky_mat_3, sky_mat_9a, sky_mat_9b, sky_mat_9c; inputs channel_output: list, channel_type: Int32, UTC: Int32, day: Int32; same code as spectral_sky
spectral_sky_9 = SpectralRadianceSkyDefinitions(
    channel_output=channeloutput_2,
    channel_type=0,
    latitude=latitude_2,
    longitude=longitude_2,
    UTC=utc_2,
    month=month_2,
    day=day_2,
    hour="15",
    normal_direct=item_25,
    horizontal_diffuse=item_26,
    temperature=item_27,
    name=concatenate_8)  # -> current_dir, sky_name_out, sky_mat_3, sky_mat_9a, sky_mat_9b, sky_mat_9c; inputs channel_output: list, channel_type: Int32, UTC: Int32, day: Int32; same code as spectral_sky
spectral_sky_10 = SpectralRadianceSkyDefinitions(
    channel_output=channeloutput_2,
    channel_type=0,
    latitude=latitude_2,
    longitude=longitude_2,
    UTC=utc_2,
    month=month_2,
    day=day_2,
    hour="16",
    normal_direct=item_28,
    horizontal_diffuse=item_29,
    temperature=item_30,
    name=concatenate_9)  # -> current_dir, sky_name_out, sky_mat_3, sky_mat_9a, sky_mat_9b, sky_mat_9c; inputs channel_output: list, channel_type: Int32, UTC: Int32, day: Int32; same code as spectral_sky
spectral_sky_11 = SpectralRadianceSkyDefinitions(
    channel_output=channeloutput_2,
    channel_type=0,
    latitude=latitude_2,
    longitude=longitude_2,
    UTC=utc_2,
    month=month_2,
    day=day_2,
    hour="17",
    normal_direct=item_31,
    horizontal_diffuse=item_32,
    temperature=item_33,
    name=concatenate_10)  # -> current_dir, sky_name_out, sky_mat_3, sky_mat_9a, sky_mat_9b, sky_mat_9c; inputs channel_output: list, channel_type: Int32, UTC: Int32, day: Int32; same code as spectral_sky
spectral_sky_12 = SpectralRadianceSkyDefinitions(
    channel_output=channeloutput_2,
    channel_type=0,
    latitude=latitude_2,
    longitude=longitude_2,
    UTC=utc_2,
    month=month_2,
    day=day_2,
    hour="18",
    normal_direct=item_34,
    horizontal_diffuse=item_35,
    temperature=item_36,
    name=concatenate_11)  # -> current_dir, sky_name_out, sky_mat_3, sky_mat_9a, sky_mat_9b, sky_mat_9c; inputs channel_output: list, channel_type: Int32, UTC: Int32, day: Int32; same code as spectral_sky
spectral_sky_13 = SpectralRadianceSkyDefinitions(
    channel_output=channeloutput_2,
    channel_type=0,
    latitude=latitude_2,
    longitude=longitude_2,
    UTC=utc_2,
    month=month_2,
    day=day_2,
    hour="19",
    normal_direct=item_37,
    horizontal_diffuse=item_38,
    temperature=item_39,
    name=concatenate_12)  # -> current_dir, sky_name_out, sky_mat_3, sky_mat_9a, sky_mat_9b, sky_mat_9c; inputs channel_output: list, channel_type: Int32, UTC: Int32, day: Int32; same code as spectral_sky
spectral_sky_14 = SpectralRadianceSkyDefinitions(
    channel_output=channeloutput_2,
    channel_type=0,
    latitude=latitude_2,
    longitude=longitude_2,
    UTC=utc_2,
    month=month_2,
    day=day_2,
    hour="20",
    normal_direct=item_40,
    horizontal_diffuse=item_41,
    temperature=item_42,
    name=concatenate_13)  # -> current_dir, sky_name_out, sky_mat_3, sky_mat_9a, sky_mat_9b, sky_mat_9c; inputs channel_output: list, channel_type: Int32, UTC: Int32, day: Int32; same code as spectral_sky
gridbasedsimulation = Honeybee_GridBasedSimulation(
    skyFile=spectral_sky.sky_mat_3,
    testPoints=testpoints_2,
    ptsVectors=testvectors_2,
    simulationType=0,
    radParameters=radparameters_2)  # -> analysisRecipe; plug-in component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
gridbasedsimulation_2 = Honeybee_GridBasedSimulation(
    skyFile=spectral_sky_2.sky_mat_3,
    testPoints=testpoints_2,
    ptsVectors=testvectors_2,
    simulationType=0,
    radParameters=radparameters_2)  # -> analysisRecipe; plug-in component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
gridbasedsimulation_3 = Honeybee_GridBasedSimulation(
    skyFile=spectral_sky_3.sky_mat_3,
    testPoints=testpoints_2,
    ptsVectors=testvectors_2,
    simulationType=0,
    radParameters=radparameters_2)  # -> analysisRecipe; plug-in component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
gridbasedsimulation_4 = Honeybee_GridBasedSimulation(
    skyFile=spectral_sky_4.sky_mat_3,
    testPoints=testpoints_2,
    ptsVectors=testvectors_2,
    simulationType=0,
    radParameters=radparameters_2)  # -> analysisRecipe; plug-in component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
gridbasedsimulation_5 = Honeybee_GridBasedSimulation(
    skyFile=spectral_sky_5.sky_mat_3,
    testPoints=testpoints_2,
    ptsVectors=testvectors_2,
    simulationType=0,
    radParameters=radparameters_2)  # -> analysisRecipe; plug-in component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
gridbasedsimulation_6 = Honeybee_GridBasedSimulation(
    skyFile=spectral_sky_6.sky_mat_3,
    testPoints=testpoints_2,
    ptsVectors=testvectors_2,
    simulationType=0,
    radParameters=radparameters_2)  # -> analysisRecipe; plug-in component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
gridbasedsimulation_7 = Honeybee_GridBasedSimulation(
    skyFile=spectral_sky_7.sky_mat_3,
    testPoints=testpoints_2,
    ptsVectors=testvectors_2,
    simulationType=0,
    radParameters=radparameters_2)  # -> analysisRecipe; plug-in component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
gridbasedsimulation_8 = Honeybee_GridBasedSimulation(
    skyFile=spectral_sky_8.sky_mat_3,
    testPoints=testpoints_2,
    ptsVectors=testvectors_2,
    simulationType=0,
    radParameters=radparameters_2)  # -> analysisRecipe; plug-in component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
gridbasedsimulation_9 = Honeybee_GridBasedSimulation(
    skyFile=spectral_sky_9.sky_mat_3,
    testPoints=testpoints_2,
    ptsVectors=testvectors_2,
    simulationType=0,
    radParameters=radparameters_2)  # -> analysisRecipe; plug-in component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
gridbasedsimulation_10 = Honeybee_GridBasedSimulation(
    skyFile=spectral_sky_10.sky_mat_3,
    testPoints=testpoints_2,
    ptsVectors=testvectors_2,
    simulationType=0,
    radParameters=radparameters_2)  # -> analysisRecipe; plug-in component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
gridbasedsimulation_11 = Honeybee_GridBasedSimulation(
    skyFile=spectral_sky_11.sky_mat_3,
    testPoints=testpoints_2,
    ptsVectors=testvectors_2,
    simulationType=0,
    radParameters=radparameters_2)  # -> analysisRecipe; plug-in component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
gridbasedsimulation_12 = Honeybee_GridBasedSimulation(
    skyFile=spectral_sky_12.sky_mat_3,
    testPoints=testpoints_2,
    ptsVectors=testvectors_2,
    simulationType=0,
    radParameters=radparameters_2)  # -> analysisRecipe; plug-in component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
gridbasedsimulation_13 = Honeybee_GridBasedSimulation(
    skyFile=spectral_sky_13.sky_mat_3,
    testPoints=testpoints_2,
    ptsVectors=testvectors_2,
    simulationType=0,
    radParameters=radparameters_2)  # -> analysisRecipe; plug-in component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
gridbasedsimulation_14 = Honeybee_GridBasedSimulation(
    skyFile=spectral_sky_14.sky_mat_3,
    testPoints=testpoints_2,
    ptsVectors=testvectors_2,
    simulationType=0,
    radParameters=radparameters_2)  # -> analysisRecipe; plug-in component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
rundaylightanalysis = Honeybee_RunDaylightSimulation(
    HBObjects=flatten(hb_objects_2),
    analysisRecipe=gridbasedsimulation,
    writeRad=runpcomb_2,
    runRad=runpcomb_2,
    workingDir=workingdir_2,
    radFileName=concatenate,
    overwriteResults=False)  # -> out, analysisType, resultsUnit, results, illuminance_values, resultFiles, illuminance_files, studyFolder, done; plug-in component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
rundaylightanalysis_2 = Honeybee_RunDaylightSimulation(
    HBObjects=flatten(hb_objects_2),
    analysisRecipe=gridbasedsimulation_2,
    writeRad=runpcomb_2,
    runRad=runpcomb_2,
    workingDir=workingdir_2,
    radFileName=concatenate_2,
    overwriteResults=False)  # -> out, analysisType, resultsUnit, results, illuminance_values, resultFiles, illuminance_files, studyFolder, done; plug-in component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
rundaylightanalysis_3 = Honeybee_RunDaylightSimulation(
    HBObjects=flatten(hb_objects_2),
    analysisRecipe=gridbasedsimulation_3,
    writeRad=runpcomb_2,
    runRad=runpcomb_2,
    workingDir=workingdir_2,
    radFileName=concatenate_3,
    overwriteResults=False)  # -> out, analysisType, resultsUnit, results, illuminance_values, resultFiles, illuminance_files, studyFolder, done; plug-in component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
rundaylightanalysis_4 = Honeybee_RunDaylightSimulation(
    HBObjects=flatten(hb_objects_2),
    analysisRecipe=gridbasedsimulation_4,
    writeRad=runpcomb_2,
    runRad=runpcomb_2,
    workingDir=workingdir_2,
    radFileName=concatenate_4,
    overwriteResults=False)  # -> out, analysisType, resultsUnit, results, illuminance_values, resultFiles, illuminance_files, studyFolder, done; plug-in component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
rundaylightanalysis_5 = Honeybee_RunDaylightSimulation(
    HBObjects=flatten(hb_objects_2),
    analysisRecipe=gridbasedsimulation_5,
    writeRad=runpcomb_2,
    runRad=runpcomb_2,
    workingDir=workingdir_2,
    radFileName=concatenate_5,
    overwriteResults=False)  # -> out, analysisType, resultsUnit, results, illuminance_values, resultFiles, illuminance_files, studyFolder, done; plug-in component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
rundaylightanalysis_6 = Honeybee_RunDaylightSimulation(
    HBObjects=flatten(hb_objects_2),
    analysisRecipe=gridbasedsimulation_6,
    writeRad=runpcomb_2,
    runRad=runpcomb_2,
    workingDir=workingdir_2,
    radFileName=concatenate_6,
    overwriteResults=False)  # -> out, analysisType, resultsUnit, results, illuminance_values, resultFiles, illuminance_files, studyFolder, done; plug-in component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
rundaylightanalysis_7 = Honeybee_RunDaylightSimulation(
    HBObjects=flatten(hb_objects_2),
    analysisRecipe=gridbasedsimulation_7,
    writeRad=runpcomb_2,
    runRad=runpcomb_2,
    workingDir=workingdir_2,
    radFileName=concatenate_7,
    overwriteResults=False)  # -> out, analysisType, resultsUnit, results, illuminance_values, resultFiles, illuminance_files, studyFolder, done; plug-in component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
rundaylightanalysis_8 = Honeybee_RunDaylightSimulation(
    HBObjects=flatten(hb_objects_2),
    analysisRecipe=gridbasedsimulation_8,
    writeRad=runpcomb_2,
    runRad=runpcomb_2,
    workingDir=workingdir_2,
    radFileName=concatenate_14,
    overwriteResults=False)  # -> out, analysisType, resultsUnit, results, illuminance_values, resultFiles, illuminance_files, studyFolder, done; plug-in component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
rundaylightanalysis_9 = Honeybee_RunDaylightSimulation(
    HBObjects=flatten(hb_objects_2),
    analysisRecipe=gridbasedsimulation_9,
    writeRad=runpcomb_2,
    runRad=runpcomb_2,
    workingDir=workingdir_2,
    radFileName=concatenate_8,
    overwriteResults=False)  # -> out, analysisType, resultsUnit, results, illuminance_values, resultFiles, illuminance_files, studyFolder, done; plug-in component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
rundaylightanalysis_10 = Honeybee_RunDaylightSimulation(
    HBObjects=flatten(hb_objects_2),
    analysisRecipe=gridbasedsimulation_10,
    writeRad=runpcomb_2,
    runRad=runpcomb_2,
    workingDir=workingdir_2,
    radFileName=concatenate_9,
    overwriteResults=False)  # -> out, analysisType, resultsUnit, results, illuminance_values, resultFiles, illuminance_files, studyFolder, done; plug-in component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
rundaylightanalysis_11 = Honeybee_RunDaylightSimulation(
    HBObjects=flatten(hb_objects_2),
    analysisRecipe=gridbasedsimulation_11,
    writeRad=runpcomb_2,
    runRad=runpcomb_2,
    workingDir=workingdir_2,
    radFileName=concatenate_10,
    overwriteResults=True)  # -> out, analysisType, resultsUnit, results, illuminance_values, resultFiles, illuminance_files, studyFolder, done; plug-in component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
rundaylightanalysis_12 = Honeybee_RunDaylightSimulation(
    HBObjects=flatten(hb_objects_2),
    analysisRecipe=gridbasedsimulation_12,
    writeRad=runpcomb_2,
    runRad=runpcomb_2,
    workingDir=workingdir_2,
    radFileName=concatenate_11,
    overwriteResults=False)  # -> out, analysisType, resultsUnit, results, illuminance_values, resultFiles, illuminance_files, studyFolder, done; plug-in component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
rundaylightanalysis_13 = Honeybee_RunDaylightSimulation(
    HBObjects=flatten(hb_objects_2),
    analysisRecipe=gridbasedsimulation_13,
    writeRad=runpcomb_2,
    runRad=runpcomb_2,
    workingDir=workingdir_2,
    radFileName=concatenate_12,
    overwriteResults=False)  # -> out, analysisType, resultsUnit, results, illuminance_values, resultFiles, illuminance_files, studyFolder, done; plug-in component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
rundaylightanalysis_14 = Honeybee_RunDaylightSimulation(
    HBObjects=flatten(hb_objects_2),
    analysisRecipe=gridbasedsimulation_14,
    writeRad=runpcomb_2,
    runRad=runpcomb_2,
    workingDir=workingdir_2,
    radFileName=concatenate_13,
    overwriteResults=False)  # -> out, analysisType, resultsUnit, results, illuminance_values, resultFiles, illuminance_files, studyFolder, done; plug-in component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
concatenate_15 = Concatenate(FragmentA=speculariafilename_2, FragmentB="_DLI")
_3_channel_par = _3ChannelPAR(
    irradiance=[rundaylightanalysis.resultFiles, rundaylightanalysis_3.resultFiles, rundaylightanalysis_4.resultFiles, rundaylightanalysis_2.resultFiles, rundaylightanalysis_5.resultFiles, rundaylightanalysis_6.resultFiles, rundaylightanalysis_7.resultFiles, rundaylightanalysis_8.resultFiles, rundaylightanalysis_9.resultFiles, rundaylightanalysis_10.resultFiles, rundaylightanalysis_11.resultFiles, rundaylightanalysis_12.resultFiles, rundaylightanalysis_13.resultFiles, rundaylightanalysis_14.resultFiles],
    RunPcomb=runpcomb_2,
    Directory=concatenate_15)  # -> out, current_dir, par_pic, simplify(par_output), photopic_pic, photopic_lux; inputs RunPcomb: Boolean
#   port RunPcomb: Set Boolean to True to run lark
# ---------- _3_channel_par: Python ----------
# 3-channel PAR 
# Provided by Specularia 1.0
# Copyright 2023 Bryant Callahan, Mehlika Inanici, Ph.D. and Gundula Prosch (University of Washington) 
# Authored by Bryant Callahan & Dr. Mehlika Inanici 

# Adapated from Lark Spectral Lighting 
# (v0.0.1-v1.0 Mehlika Inanici, Ph.D.,University of Washington/Marty Brennan, ZGF Architects LLP; v2.0 Clotilde Pierson, Ph.D., EPFL, Oregon State University/ Myrta Gkaintatzi-Masouti, M.Sc., Eindhoven University of Technology.

# Licensed under The Modified 3-Clause BSD License (the "License");
# You may obtain a copy of the License at
# https://opensource.org/licenses/BSD-3-Clause

"""
Use this component to evaluate photosynthetically active radiation (PAR) in the 380-700 nm range of daylight spectra across three channels.

Args:
        picture: filepath to 3-channel image [rgb]
        irradiance: filepath to 3-channel irradiance output (example .dat, .res)
        RunPcomb: Set Boolean to True to run simulation
        Directory: optional subfolder name (default folder is C:\specularia)
    Returns:
        out: warnings and errors
        current_dir: current working folder 
        par_pic: filepath to PAR picture 
        par_output: Photosynthetic Active Radiance (PAR) output [McCree-Sager curve]
        photopic_pic: filepath to photopic luminance picture
        photopic_lux: list of photopic illuminance
"""

ghenv.Component.Name = "3-channel PAR"
ghenv.Component.NickName = '3-channel PAR'
ghenv.Component.Message = 'Specularia v1.0'
ghenv.Component.Category = "Specularia"
ghenv.Component.SubCategory = "0_Setup"


#import libraries
import os
from subprocess import Popen


#check all inputs
error_list = []
inputs = [picture,irradiance,RunPcomb]
inputs_name = ["picture","irradiance","RunPcomb"]

for idx, val in enumerate (inputs):
    if val == None or val == []:
        error_list.append(inputs_name[idx])

if len(error_list) != 0:
    check = "error"
else:
    check = 1

if check == "error":
    print "Warning! Connect the following inputs:" 
    print error_list


#make Specularia directory if none exists
basedir = 'C:\specularia'
if os.path.isdir(basedir) != True: 
    os.makedirs(basedir)
else:
    pass


#create path to directory if provided
if Directory == None:
    path = basedir
else:
    path = os.path.join (basedir, Directory)


#create folder if directory is provided
if os.path.isdir(path) != True: 
    os.makedirs(path)
else:
    pass
os.chdir(path)


#print out current directory
current_dir = path


#process image
if picture != None:
    
    #Sum (radiometric values *  photopic v lambda action curve)
    v1 = "pcomb -h -e " """ "ro=ri(1) * 0.265 ;go=gi(1) * 0.67 ;bo=bi(1) * 0.065" """ + "-o " + picture + " > vtemp.hdr"
    vtotal = "pcomb -h -e" """ "ro=ri(1)+ gi(1) + bi(1);go=ri(1) + gi(1) + bi(1);bo=ri(1) + gi(1) + bi(1)" """ + "-o vtemp.hdr > Calc3Lum.hdr"
    
    #Sum (radiometric values * photsynthetic active radiation)
    par = "pcomb  -e " """  "ro=ri(1) * 0.4141 ;go=gi(1) * 0.2963 ;bo=bi(1) * 0.2896"  """ + picture + " > " + "par_temp.hdr" 
    par_total = "pcomb  -e " """  "ro=ri(1)+ gi(1) + bi(1) ;go=ri(1) + gi(1) + bi(1) ;bo=ri(1) + gi(1) + bi(1)" """ + "-o par_temp.hdr > Calc3PAR.hdr"
    
    tempdel = "del *temp*"
    
    batch = open("batchfile3.bat", "w")
    batch.write(v1 + '\n' + vtotal + '\n' + par + '\n' + par_total + '\n' + tempdel)
    batch.close()
    
    if RunPcomb != True:
        print "Set RunPcomb to true"
        pass
    else:
        runbatch = Popen("batchfile3.bat", cwd=path)
        stdout, stderr = runbatch.communicate()
    
    #print filepaths for output pictures
    photopic_pic = os.getcwd() + "\\" + "Calc3Lum.hdr"
    par_pic = os.getcwd() + "\\" + "Calc3PAR.hdr"


#process irradiance
if irradiance != None:
    
    #calculate 3-channel irradiance for photopic lux and PAR 
    #outputs work for different Radiance extensions (.dat,.res)
    f = open(irradiance, 'r')
    
    #create output tables
    result_pho = []
    result_par = []
    
    v = open('photopic_lux.txt', 'w')
    par = open('par_output.txt', 'w')
    
    #loop on each row for photopic and PAR calculations
    for line in f:
        R,G,B = line.split()[0:3]
        
        voutput = 179 * (0.265 * float(R) + 0.67 * float(G) + 0.065 * float(B))   #photopic lux output 
        par_output = 2.02 * (0.4141 * float(R) + 0.2963 * float(G) + 0.2896 * float(B))  #PAR output in moles-m2-s (ppfd)
        
        v.write(str(voutput) + '\n')
        par.write(str(par_output) + '\n')
        
        result_pho.append(voutput)
        result_par.append(par_output)
    
    #assign output tables
    photopic_lux = result_pho
    par_output = result_par
    
    f.close()
    v.close()
    par.close()
# ---------- end _3_channel_par ----------
out = Data([rundaylightanalysis.out, rundaylightanalysis_14.out, rundaylightanalysis_13.out, rundaylightanalysis_2.out, rundaylightanalysis_12.out, rundaylightanalysis_4.out, rundaylightanalysis_3.out, rundaylightanalysis_11.out, rundaylightanalysis_5.out, rundaylightanalysis_10.out, rundaylightanalysis_6.out, rundaylightanalysis_9.out, rundaylightanalysis_7.out, rundaylightanalysis_8.out])
out_2 = ClusterOutput(out)
seconds_to_hours_conversion = Integer(3600)
flip_matrix = FlipMatrix(Data=_3_channel_par.par_output)
multiplication = Multiplication(A=_3_channel_par.par_output, B=seconds_to_hours_conversion)
flip_matrix_2 = FlipMatrix(Data=multiplication)
mass_addition = MassAddition(Input=flip_matrix_2)  # -> Result, PartialResults
power = Power(A=10, B=6)
division = Division(A=mass_addition.Result, B=power)
par_hourly = Data(flip_matrix_2)
par_ppfd = Data(flip_matrix)
dli = Data(division)
par_hourly_2 = ClusterOutput(par_hourly)
par_ppfd_2 = ClusterOutput(par_ppfd)
dli_2 = ClusterOutput(dli)
