# Grasshopper definition Specularia_9Channel_ElectricLight.gh (Grasshopper 1.0.7)
# plug-ins: LadybugGrasshopper, 9-channel PAR, Spectral Sky, Spectral Materials

# ----
# 4. Electric Lighting Parameters
# If supplemental electric light is included as one of the soruces, set the following parameters:
# - Path to the text file containing the Spectral Power Distribution (SPD) of the electric light source.
# - Path to the .ies file containing the luminous distribution of the electric light source
# - Wavelength interval of the SPD file (typically 1, 5, or 10nm)
# - Light Loss Factor (LLF) for the electric light source (leave it at 1 for default)
# - Name of the electric light source
# - the spin, tilt, and orientation angles of the electric light source in
# - Spin, Tilt angle, & Orientation angles
# 
# Finally, select the layer in Rhino which contains the points defining the positions of your electric light sources.
# Then in the Pipeline layer field, type an asterisk followed by the layer name exactly as it appears.
wavelength_interval_in_spd_txt_file = Slider(1, range=1..10)
llf = Slider(1, range=0..1)
spin_angle = Slider(0, range=0..1000)
tilt_angle = Slider(0, range=-180..180)
orientation_angle = Slider(90, range=-180..180)
rhino_layer_id_of_luminaire = Slider(4, range=0..20)
electric_light_name = Text("LED")
path_to_spd_txt_file = FilePath()
path_to_ies_file = FilePath()
panel = Panel(path_to_ies_file)
panel_2 = Panel(path_to_spd_txt_file)
panel_3 = Panel(electric_light_name)
pipeline = GeometryPipeline(
    GroupByLayer=False,
    GroupByType=False,
    IncludeHidden=True,
    IncludeLocked=True,
    LayerFilter="*luminaires",
    NameFilter="*",
    SublayerFiltering=True,
    TypeFilter=1)
layers = GhPythonScript()  # -> out
# ---------- layers: Python ----------
import rhinoscriptsyntax as rs
import scriptcontext as sc
import Rhino as rh
import GhPython as gp

sc.doc = rh.RhinoDoc.ActiveDoc
layers = rs.LayerNames()
for e in layers:
    print e
# ---------- end layers ----------
panel_4 = Panel(layers)
item = ListItem(List=panel_4, Index=rhino_layer_id_of_luminaire, Wrap=True)
panel_5 = Panel(item)

# ----
# 3. Daylight Parameters
# 3.1 Set the point in time you want to simulate (month, day, and hour).
# 3.2 EPW or Manual Overwrite
# 
# a) either input a weather file (RECOMMENDED)
# or manually overwrite based on your own input parameters (ADVANCED)
# b) or switch the "Overwrite the epw file data" to TRUE and set up the
# Direct Normal Irradiance (DNI), Diffuse Horizontal Irradiance (DHI),
# and Dew Point Temperature (Td) of the sky under which you want
# to simulate.
# 3.3. SPD & Wavelength
# 
# Select the desired color temperature for the spectral power distribution
# (SPD) of the sky, or input a custom SPD.
# Make sure the wavelengths match the
# wavelength interval of your custom SPD.
overwrite_epw_file_data = BooleanToggle(False)
dni_w_m2 = Slider(0, range=0..1000)
dhi_w_m2 = Slider(0, range=0..1000)
td_c = Slider(0, range=-50..50)
latitude = Slider(46.25, range=-90..90)
longitude = Slider(6.13, range=-90..90)
time_zone = Slider(1, range=0..10)
month = Slider(12, range=1..12)
day = Slider(21, range=1..31)
hour = Slider(12, range=0..23.9)
weather_file_epw = FilePath()
wavelengths = Text(["380", "381", "382", "383", "384", "385", "386", "387", "388", "389"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])
daylight = ValueList({"5000K": 0, "6500K": 1, "9000K": 2, "Custom": 3}, selected="6500K")
panel_6 = Panel(weather_file_epw)
cluster = Cluster(gate=daylight)

# ----
# 2. Sensor Arrangement
# 2.1 Individual, view-based sensor vs grid-based
# with a single view direction.
# 
# For individual sensor points, proceed to next step. To
# set up a grid-based sensor array, skip to step 2.3.
# 2.3 For grid-based analysis, set a surface on which the sensors should be located.
analysis_surface = Surface(<surface referenced from the Rhino model>)
sensor_spacing = Slider(2, range=0..2)
sensor_height = Slider(0, range=0..3)
unit_z = UnitZ(Factor=1)
location_point = Point(Point(12.5, 0, 0))
direction_point = Point(Point(12.5, 50, 0))
# 2.2 If you selected individual sensor(s), set up the point at which the
# sensor should be located in "Location point" and the point at which
# the sensor should look towards in "Direction point".
sensor_s = ValueList({"individual sensor(s)": 0, "sensor grid": 1}, selected="sensor grid")
vec2pt = Vector2Pt(PointA=location_point, PointB=direction_point, Unitize=False)  # -> Vector, Length
sensor_view_direction = Vector(vec2pt.Vector)
sensor_location = Point(location_point)
genmesh = Ladybug_GenerateMesh(testGeometry=analysis_surface, gridSize=sensor_spacing, distBaseSrf=sensor_height, moveTestMesh=True)  # -> readMe, simplify(testPoints), simplify(ptsVectors), simplify(facesArea), simplify(mesh); plug-in component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
lng = ListLength(List=genmesh.testPoints)
repeat = RepeatData(Data=unit_z, Length=lng)  # -> simplify(Data)
flip = FlipMatrix(Data=repeat)
sensor_locations = Point(flatten(genmesh.testPoints))
view_direction = Vector(flatten(flip))
location = StreamFilter(Gate=sensor_s, Stream0=sensor_location, Stream1=sensor_locations)
direction = StreamFilter(Gate=sensor_s, Stream0=sensor_view_direction, Stream1=view_direction)

# ----
# 6. Radiance Parameters
# Set up the Radiance parameters to run your simulations.
simulation_type = Slider(0, range=0..2)
radiance_ab = Slider(2, range=0..10)
radiance_quality = Slider(1, range=0..2)
radiance_ad = Slider(1024, range=1..10000)
radiance_as = Slider(500, range=0..1000)
radiance_ar = Slider(100, range=0..1000)
radiance_aa = Slider(0.1, range=0..1)
working_directory = Text("C:\lark\temp")
honeybee = Honeybee_Honeybee()  # -> Vviiiiiiiiiizzz; plug-in component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
ladybug = Ladybug_Ladybug()  # -> Vviiiiiiiiiizzz; plug-in component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
radparameters = Honeybee_RADParameters(
    quality=radiance_quality,
    ab=radiance_ab,
    ad=radiance_ad,
    as=radiance_as,
    ar=radiance_ar,
    aa=radiance_aa,
    additionalP="-lw 0.0001")  # -> readMe, radParameters; plug-in component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

# ----
# 5. Material Parameters
# For each material in your scene, set up:
# 
# - Material type (0 for glass, 1 for plastic)
# - Path to the usr/txt file containing the spectral caracteristic (transmission/reflection) of the material
# - Wavelength interval of the SPD used for the simulation
# - Material roughness
# - Material specularity
# - Assign each layer in Rhino to the corresponding elements, then type the exact layer name into the "Pipeline"
# box preceded by an asterisk.
path_to_spectral_characteristics_file = FilePath()
specularity_of_material = Slider(0, range=0..1)
rhino_layer_id_of_material = Slider(0, range=0..20)
path_to_spectral_characteristics_file_2 = FilePath()
wavelength_interval_in_spectral_characte = Slider(10, range=0..10)  # "Wavelength interval in spectral characteristics file"
roughness_of_material = Slider(0, range=0..1)
specularity_of_material_2 = Slider(0.2, range=0..1)
rhino_layer_id_of_material_2 = Slider(2, range=0..20)
material_type = Slider(0, range=0..1)
wavelength_interval_in_spectral_characte_2 = Slider(10, range=0..10)  # "Wavelength interval in spectral characteristics file"
roughness_of_material_2 = Slider(0, range=0..1)
material_type_2 = Slider(1, range=0..1)
panel_7 = Panel(path_to_spectral_characteristics_file)
panel_8 = Panel(path_to_spectral_characteristics_file_2)
item_2 = ListItem(List=panel_4, Index=rhino_layer_id_of_material, Wrap=True)
item_3 = ListItem(List=panel_4, Index=rhino_layer_id_of_material_2, Wrap=True)
pipeline_2 = GeometryPipeline(
    GroupByLayer=False,
    GroupByType=False,
    IncludeHidden=True,
    IncludeLocked=True,
    LayerFilter="*envelope",
    NameFilter="*",
    SublayerFiltering=True,
    TypeFilter=1073741848)
pipeline_3 = GeometryPipeline(
    GroupByLayer=False,
    GroupByType=False,
    IncludeHidden=True,
    IncludeLocked=True,
    LayerFilter="*ground",
    NameFilter="*",
    SublayerFiltering=True,
    TypeFilter=1073741848)
panel_9 = Panel(item_2)
panel_10 = Panel(item_3)

# ----
# INPUTS
# Establish input paramaters before running simulation
# 1. Light Source
# Select light source(s):
light_source = ValueList({"daylight": 0, "electric": 1, "both": 2}, selected="electric")

# ----
# 8. Light Source Definition
light_distribution_toggle = BooleanToggle(True)
specularia_spectral_materials = SpeculariaSpectralMaterials(
    Spd_input=panel_2,
    Source_interval=wavelength_interval_in_spd_txt_file,
    Material_name=panel_3,
    Material_type=3,
    Channel_type=1)  # -> Current_dir, Channel_output, Mat_3, Mat_9a, Mat_9b, Mat_9c
electric_light_working_dir = Text("C:\specularia\luminaires")
spd_in_9_channels = Panel(specularia_spectral_materials.Channel_output)
par_coefficients = Panel("""0.1426
0.147
0
0.1105
0.0976
0.0882
0
0.1898
0.2244""")
multiplication = Multiplication(A=spd_in_9_channels, B=par_coefficients)
ma = MassAddition(Input=multiplication)  # -> Result, PartialResults
division = Division(A=spd_in_9_channels, B=ma.Result)
panel_11 = Panel(division)

specularia_spectral_materials_2 = SpeculariaSpectralMaterials(
    Spd_input=panel_7,
    Source_interval=wavelength_interval_in_spectral_characte_2,
    Excel_daylight_series_cal=False,
    Material_name=panel_9,
    Roughness=roughness_of_material_2,
    Specularity=specularity_of_material,
    Material_type=material_type,
    Channel_type=1)  # -> Current_dir, Channel_output, Mat_3, Mat_9a, Mat_9b, Mat_9c
specularia_spectral_materials_3 = SpeculariaSpectralMaterials(
    Spd_input=panel_8,
    Source_interval=wavelength_interval_in_spectral_characte,
    Material_name=panel_10,
    Roughness=roughness_of_material,
    Specularity=specularity_of_material_2,
    Material_type=material_type_2,
    Channel_type=1)  # -> Current_dir, Channel_output, Mat_3, Mat_9a, Mat_9b, Mat_9c

# ----
# 9. Material Definition
create_directory = CreateSpeculariaDirectory(mat=specularia_spectral_materials_2.Mat_9b)  # -> out, rad_def
# ---------- create_directory: Python ----------
# Create Directory
# Provided by Specularia 1.0
# Copyright 2023 Bryant Callahan, Mehlika Inanici, Ph.D. and Gundula Prosch (University of Washington) 
# Authored by Bryant Callahan & Dr. Mehlika Inanici 

# Adapated from Lark Spectral Lighting
# (v0.0.1-v1.0 Mehlika Inanici, Ph.D.,University of Washington/Marty Brennan, ZGF Architects LLP; v2.0 Clotilde Pierson, Ph.D., EPFL, Oregon State University/ Myrta Gkaintatzi-Masouti, M.Sc., Eindhoven University of Technology.

# Licensed under The Modified 3-Clause BSD License (the "License");
# You may obtain a copy of the License at
# https://opensource.org/licenses/BSD-3-Clause

"""
Use this component to create a directory for Specularia if none exists

    Inputs:
        mat: input from spectral materials output
    Output:
        rad_def: radiance definition
"""

ghenv.Component.Name = "Create Specularia Directory"
ghenv.Component.NickName = 'Create Directory'
ghenv.Component.Message = 'Specularia v1.0'
ghenv.Component.Category = "Specularia"
ghenv.Component.SubCategory = "Utilities"


import re
import os


#make Specularia directory if none exists
_path = 'C:\specularia\materials'
if os.path.isdir(_path) != True: 
    os.makedirs(_path)
else:
    pass

os.chdir(_path)
#print out current directory
current_dir = _path

material =  []
fopen = open(mat, 'r')
rad_def = fopen.read()
fopen.close()
# ---------- end create_directory ----------
create_directory_2 = CreateSpeculariaDirectory(mat=specularia_spectral_materials_2.Mat_9c)  # -> out, rad_def; same code as create_directory
create_directory_3 = CreateSpeculariaDirectory(mat=specularia_spectral_materials_3.Mat_9a)  # -> out, rad_def; same code as create_directory
create_directory_4 = CreateSpeculariaDirectory(mat=specularia_spectral_materials_3.Mat_9b)  # -> out, rad_def; same code as create_directory
create_directory_5 = CreateSpeculariaDirectory(mat=specularia_spectral_materials_3.Mat_9c)  # -> out, rad_def; same code as create_directory
create_directory_6 = CreateSpeculariaDirectory(mat=specularia_spectral_materials_2.Mat_9a)  # -> out, rad_def; same code as create_directory
B = Panel(create_directory_3.rad_def)
B_2 = Panel(create_directory_6.rad_def)
G = Panel(create_directory_4.rad_def)
G_2 = Panel(create_directory.rad_def)
R = Panel(create_directory_5.rad_def)
R_2 = Panel(create_directory_2.rad_def)

# ----
# RUN
# Generate sky file,
# then run simulation
write_light_file_s = LBFalseStartToggle(False)
run_simulation = LBFalseStartToggle(False)

# ----
# 7. Sky Definition
importepw = Ladybug_ImportEpw(epwFile=weather_file_epw)  # -> readMe, latitude, location, dryBulbTemperature, dewPointTemperature, relativeHumidity, windSpeed, windDirection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; plug-in component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
# SETUP
# Once sensors, weather, and materials have
# been set, create the sky file and set directory
merge = Merge(Data1=graft(wavelengths), Data2=graft(cluster))
separator = Text(" ")
join = TextJoin(Text=merge, Join=separator)  # -> flatten(Result)
item_4 = ListItem(List=wavelengths, Index=1, Wrap=True)
diffuseskyspd = Text("DiffuseSkySPD")
explodelocation = Ladybug_DecomposeLocation(location=importepw.location)  # -> locationName, latitude, longitude, timeZone, elevation; plug-in component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
strnum = Ladybug_SeparateData(inputList=flatten(importepw.dewPointTemperature))  # -> numbers, strings; plug-in component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
strnum_2 = Ladybug_SeparateData(inputList=flatten(importepw.diffuseHorizontalRadiation))  # -> numbers, strings; plug-in component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
strnum_3 = Ladybug_SeparateData(inputList=flatten(importepw.directNormalRadiation))  # -> numbers, strings; plug-in component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
item_5 = ListItem(List=wavelengths, Index=0, Wrap=True)
file_writer = LarkWriteToCsvOrTxtFile(folder=working_directory, filename=diffuseskyspd, extension=2, data=join, write=write_light_file_s)  # -> out, file; inputs extension: Int32, data: list
# ---------- file_writer: Python ----------
# Write results to file.

# Lark Spectral Lighting (v0.0.1, v0.0.2 and v1.0) is a collaboration of University of Washington and ZGF Architects LLP
# Authors Dr. Mehlika Inanici, Marty Brennan & Ed Clark
# Lark v2.0 is a collaboration of EPFL, Oregon State University, and Eindhoven University of Technology
# Authors Dr. Clotilde Pierson & Myrta Gkaintatzi-Masouti
# Copyright 2015-2022 Mehlika Inanici, Ph.D. (University of Washington) and ZGF Architects LLP
# Copyright 2022 Clotilde Pierson, Ph.D. (EPFL, Oregon State University) and Myrta Gkaintatzi-Masouti, M.Sc. (Eindhoven University of Technology)
# Licensed under The Modified 3-Clause BSD License (the "License");
# You may obtain a copy of the License at
# https://opensource.org/licenses/BSD-3-Clause

"""
Write data to csv or txt file
-
Provided by Lark 2.0.0

    Inputs:
        folder: folder path
        filename: name of the file to write
        extension: [1 = .csv] [2 = .txt]
        data: data to write
        headings: optional column headings for the data
        write: boolean toggle to run this component
    Output:
        file: file path
"""

__author__ = "mgkaintatzi-masouti"
__version__ = "2021.09.15"

ghenv.Component.Name = "Lark Write To csv Or txt File"
ghenv.Component.NickName = "File Writer"
ghenv.Component.Message = '2.0.0'
ghenv.Component.Category = "Lark"
ghenv.Component.SubCategory = "Utilities"

import os
from Grasshopper.Kernel import GH_RuntimeMessageLevel as RML



#check all inputs
error_list = []
inputs = [folder, filename, extension, data, write]
inputs_name = ["folder", "filename", "extension", "data", "write"]

for idx, val in enumerate (inputs):
    if val == None or val == []:
        error_list.append(inputs_name[idx])

if len(error_list) != 0:
    check = "error"
else:
    check = 1

if check == "error":
    print "Warning! Connect the following inputs:" 
    print error_list



#write to file
if check != "error":
    
    #make directory if none exists
    if os.path.isdir(folder) != True: 
        os.makedirs(folder)
    else:
        pass
    
    if write == True:
        if folder and filename and data: 
            folder.replace("\\", "/")
            if extension == 1:
                file = folder + "\\" + filename + '.csv'
            elif extension == 2:
                file = folder + "\\" + filename + '.txt'
            
            f = open(file,"w")
            if headings:
                f.write(headings +'\n')
            for d in data:
                f.write(d + '\n')
            f.close()
# ---------- end file_writer ----------
doy_hoy = Ladybug_DOY_HOY(days=day, months=month, hours=hour)  # -> HOY, DOY, date; plug-in component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
subtraction = Subtraction(A=item_4, B=item_5)
specularia_spectral_materials_4 = SpeculariaSpectralMaterials(
    Spd_input=file_writer.file,
    Source_interval=subtraction,
    Excel_daylight_series_cal=False,
    Material_type=2,
    Channel_type=1)  # -> Current_dir, Channel_output, Mat_3, Mat_9a, Mat_9b, Mat_9c
item_6 = ListItem(List=strnum_3.numbers, Index=doy_hoy.HOY, Wrap=True)
item_7 = ListItem(List=strnum_2.numbers, Index=doy_hoy.HOY, Wrap=True)
item_8 = ListItem(List=strnum.numbers, Index=doy_hoy.HOY, Wrap=True)
filter = StreamFilter(Gate=overwrite_epw_file_data, Stream0=explodelocation.latitude, Stream1=latitude)
filter_2 = StreamFilter(Gate=overwrite_epw_file_data, Stream0=explodelocation.longitude, Stream1=longitude)
filter_3 = StreamFilter(Gate=overwrite_epw_file_data, Stream0=explodelocation.timeZone, Stream1=time_zone)
filter_4 = StreamFilter(Gate=overwrite_epw_file_data, Stream0=item_6, Stream1=dni_w_m2)
filter_5 = StreamFilter(Gate=overwrite_epw_file_data, Stream0=item_7, Stream1=dhi_w_m2)
filter_6 = StreamFilter(Gate=overwrite_epw_file_data, Stream0=item_8, Stream1=td_c)
latitude_2 = Number(filter)
longitude_2 = Number(filter_2)
time_zone_2 = Number(filter_3)
dew_point_temperature = Number(filter_6)
normal_direct_irradiance = Number(filter_4)
horizontal_diffuse_irradiance = Number(filter_5)
gendarksky = Honeybee_GenerateDarkSky()  # -> skyFilePath; plug-in component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

specularia_spectral_sky = SpeculariaSpectralSky(
    Channel_output=specularia_spectral_materials_4.Channel_output,
    Channel_type=1,
    Latitude=latitude_2,
    Longitude=longitude_2,
    UTC=time_zone_2,
    Month=month,
    Day=day,
    Hour=hour,
    Normal_direct=normal_direct_irradiance,
    Horizontal_diffuse=horizontal_diffuse_irradiance,
    Temperature=dew_point_temperature)  # -> Current_dir, Sky_name_out, Sky_mat_3, Sky_mat_9a, Sky_mat_9b, Sky_mat_9c

create_directory_7 = CreateSpeculariaDirectory(mat=specularia_spectral_sky.Sky_mat_9a)  # -> out, rad_def; same code as create_directory
create_directory_8 = CreateSpeculariaDirectory(mat=specularia_spectral_sky.Sky_mat_9c)  # -> out, rad_def; same code as create_directory
create_directory_9 = CreateSpeculariaDirectory(mat=specularia_spectral_sky.Sky_mat_9b)  # -> out, rad_def; same code as create_directory
panel_12 = Panel(create_directory_7.rad_def)
panel_13 = Panel(create_directory_9.rad_def)
panel_14 = Panel(create_directory_8.rad_def)

# ----
# 10b. Green channels
sky_filename = Panel(specularia_spectral_sky.Sky_mat_9b)
iesluminairezone = Honeybee_IESLuminaireZone(ptsList=pipeline, spin=spin_angle, tilt=tilt_angle, orientation=orientation_angle)  # -> readMe, luminaireZone; plug-in component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
concat = Concatenate(Luminaire_type=panel_3, Root="green", JoinSeparator="_")
iescustomlamp = Honeybee_IESCustomLamp(lampName=concat, rgbColors=ColourSwatch(SwatchColor=RGB(255, 255, 255)))  # -> readMe, lampDetails, customLamp; plug-in component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
concat_2 = Concatenate(Place="RadSimu", Root="green", Channel="9", JoinSeparator="_")
filter_7 = StreamFilter(Gate=light_source, Stream0=sky_filename, Stream1=gendarksky, Stream2=sky_filename)
iesluminaire = Honeybee_IESLuminaire(
    iesFilePath=panel,
    luminaireZone=flatten(iesluminairezone.luminaireZone),
    lightLossFactor=llf,
    customLumName=concat,
    customLamp=iescustomlamp.customLamp,
    drawLuminaireWeb=light_distribution_toggle,
    radDir=electric_light_working_dir,
    writeRad=write_light_file_s)  # -> luminaireDetails, luminaireGeo, luminaireList, elecLightingData, radFilePath; plug-in component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
gridbasedsimulation = Honeybee_GridBasedSimulation(
    skyFile=filter_7,
    testPoints=location,
    ptsVectors=direction,
    simulationType=simulation_type,
    radParameters=radparameters.radParameters)  # -> analysisRecipe; plug-in component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
createhbsrfs = Honeybee_createHBSrfs(geometry=pipeline_2, RADMaterial=G_2)  # -> readMe, simplify(HBSurface); plug-in component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
createhbsrfs_2 = Honeybee_createHBSrfs(geometry=pipeline_3, RADMaterial=G)  # -> readMe, simplify(HBSurface); plug-in component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
filter_8 = StreamFilter(Gate=light_source, Stream1=iesluminaire.radFilePath, Stream2=iesluminaire.radFilePath)
split = TextSplit(Text=iesluminaire.radFilePath, Separators="\")
item_9 = ListItem(List=split, Index=0, Wrap=True)
item_10 = ListItem(List=split, Index=1, Wrap=True)
item_11 = ListItem(List=split, Index=2, Wrap=True)
item_12 = ListItem(List=split, Index=3, Wrap=True)
concatenate = Concatenate(Fragment_A=item_9, Fragment_B=item_10, Fragment_C=item_11, Fragment_D=item_12, JoinSeparator="\")
rundaylightanalysis = Honeybee_RunDaylightSimulation(
    HBObjects=flatten([createhbsrfs.HBSurface, createhbsrfs_2.HBSurface]),
    analysisRecipe=gridbasedsimulation,
    writeRad=run_simulation,
    runRad=run_simulation,
    workingDir=working_directory,
    radFileName=concat_2,
    additionalRadFiles=flatten(filter_8),
    overwriteResults=True)  # -> out, analysisType, resultsUnit, results, illuminance_values, resultFiles, illuminance_files, studyFolder, done; plug-in component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
_1 = Integer(1)
colored_luminaire = CreateColoredLuminaire(path=concatenate, filename=concat, RGB_triplet=panel_11, count=_1)  # -> out, file; inputs RGB_triplet: list, count: Int32
#   port out: warnings and errors
# ---------- colored_luminaire: Python ----------
# Create Colored Luminaire

#Provided by Specularia 1.0
# Copyright 2023 Bryant Callahan, Mehlika Inanici, Ph.D. and Gundula Prosch (University of Washington) 
# Authored by Bryant Callahan & Dr. Mehlika Inanici 

# Adapated from Lark Spectral Lighting 
# (v0.0.1-v1.0 Mehlika Inanici, Ph.D.,University of Washington/Marty Brennan, ZGF Architects LLP; v2.0 Clotilde Pierson, Ph.D., EPFL, Oregon State University/ Myrta Gkaintatzi-Masouti, M.Sc., Eindhoven University of Technology.

# Licensed under The Modified 3-Clause BSD License (the "License");
# You may obtain a copy of the License at
# https://opensource.org/licenses/BSD-3-Clause

"""
Use this component to modifiy an existing rad file for a luminaire by adding the RGB color to it.

    Args:
        path: folder path of the existing luminaire rad file
        filename: filename of the existing luminaire rad file
        RGB_triplet: a list of 9 values that describe the spectral power distribution of the luminaire
        count: 0: blue part of the spectrum (first 3 of the 9 spectral values), 1: green part of the spectrum (second 3 of the 9 spectral values), 2: red part of the spectrum (last 3 of the 9 spectral values)
    Returns:
        file: modified filename (this is the same as the input file, the component modifies the existing and does not create a new)
"""

ghenv.Component.Name = "Create Colored Luminaire"
ghenv.Component.NickName = 'Colored Luminaire'
ghenv.Component.Message = 'Specularia v1.0'
ghenv.Component.Category = "Specularia"
ghenv.Component.SubCategory = "Lighting"

import re
import os


#check all inputs
error_list = []
inputs = [path, filename, RGB_triplet, count]
inputs_name = ["path", "filename", "RGB_triplet", "count"]

for idx, val in enumerate (inputs):
    if val == None or val == []:
        error_list.append(inputs_name[idx])

if len(error_list) != 0:
    check = "error"
else:
    check = 1

if check == "error":
    print "Warning! Connect the following inputs:" 
    print error_list

if filename == None:        
    filename = ""


#replace RGB triplet in electric light source file
if check != "error":
    
    #provide a directory with .rad file in folder
    _path = path
    if os.path.isdir(_path) != True: 
        os.makedirs(_path)
    else:
        pass
    os.chdir(_path)
    
    #print out current directory
    current_dir = _path
    
    #detect the triplet by choosing first and last value of one slice
    slice = [0,3],[3,6],[6,9]
    start = slice[count][0]
    end = slice[count][1]
    triplet = RGB_triplet[start:end]
    
    #substitue the RGB values
    substitute = 3,triplet[0],triplet[1],triplet[2]
    substitute = ' '.join(map(str, substitute))
    
    #define a regex function to write a new electric light source file
    def replace( filepath, subs, flags=0 ):
        with open( filepath, "r+" ) as file:
            fileContents = file.read()
            textPattern = re.compile(ur'3 1 1 1') #regex for Radiance default light
            fileContents = textPattern.sub( subs, fileContents ) #replace regex with subs 
            file.seek( 0 )
            file.truncate()
            file.write( fileContents )
    
    #write a new electric light source file
    file = filename + '.rad'
    replace (file, substitute)
    radfile = current_dir + file
    
    #print out the electric light source file
    print radfile
# ---------- end colored_luminaire ----------

# ----
# 10a. Blue channels
panel_15 = Panel("blue")
sky_filename_2 = Panel(specularia_spectral_sky.Sky_mat_9a)
iesluminairezone_2 = Honeybee_IESLuminaireZone(ptsList=pipeline, spin=spin_angle, tilt=tilt_angle, orientation=orientation_angle)  # -> readMe, luminaireZone; plug-in component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
concat_3 = Concatenate(Luminaire_type=panel_3, Root=panel_15, JoinSeparator="_")
iescustomlamp_2 = Honeybee_IESCustomLamp(lampName=concat_3, rgbColors=ColourSwatch(SwatchColor=RGB(255, 255, 255)))  # -> readMe, lampDetails, customLamp; plug-in component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
concat_4 = Concatenate(Place="RadSimu", Root=panel_15, Channel="9", JoinSeparator="_")
filter_9 = StreamFilter(Gate=light_source, Stream0=sky_filename_2, Stream1=gendarksky, Stream2=sky_filename_2)
iesluminaire_2 = Honeybee_IESLuminaire(
    iesFilePath=panel,
    luminaireZone=flatten(iesluminairezone_2.luminaireZone),
    lightLossFactor=llf,
    customLumName=concat_3,
    customLamp=iescustomlamp_2.customLamp,
    drawLuminaireWeb=light_distribution_toggle,
    radDir=electric_light_working_dir,
    writeRad=write_light_file_s)  # -> luminaireDetails, luminaireGeo, luminaireList, elecLightingData, radFilePath; plug-in component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
gridbasedsimulation_2 = Honeybee_GridBasedSimulation(
    skyFile=filter_9,
    testPoints=location,
    ptsVectors=direction,
    simulationType=simulation_type,
    radParameters=radparameters.radParameters)  # -> analysisRecipe; plug-in component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
createhbsrfs_3 = Honeybee_createHBSrfs(geometry=pipeline_2, RADMaterial=B_2)  # -> readMe, simplify(HBSurface); plug-in component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
createhbsrfs_4 = Honeybee_createHBSrfs(geometry=pipeline_3, RADMaterial=B)  # -> readMe, simplify(HBSurface); plug-in component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
filter_10 = StreamFilter(Gate=light_source, Stream1=iesluminaire_2.radFilePath, Stream2=iesluminaire_2.radFilePath)
split_2 = TextSplit(Text=iesluminaire_2.radFilePath, Separators="\")
item_13 = ListItem(List=split_2, Index=0, Wrap=True)
item_14 = ListItem(List=split_2, Index=1, Wrap=True)
item_15 = ListItem(List=split_2, Index=2, Wrap=True)
item_16 = ListItem(List=split_2, Index=3, Wrap=True)
concatenate_2 = Concatenate(Fragment_A=item_13, Fragment_B=item_14, Fragment_C=item_15, Fragment_D=item_16, JoinSeparator="\")
rundaylightanalysis_2 = Honeybee_RunDaylightSimulation(
    HBObjects=flatten([createhbsrfs_3.HBSurface, createhbsrfs_4.HBSurface]),
    analysisRecipe=gridbasedsimulation_2,
    writeRad=run_simulation,
    runRad=run_simulation,
    workingDir=working_directory,
    radFileName=concat_4,
    additionalRadFiles=flatten(filter_10),
    overwriteResults=True)  # -> out, analysisType, resultsUnit, results, illuminance_values, resultFiles, illuminance_files, studyFolder, done; plug-in component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
_0 = Integer(0)
colored_luminare = CreateColoredLumiaire(path=concatenate_2, filename=concat_3, RGB_triplet=panel_11, count=_0)  # -> out, file; inputs RGB_triplet: list, count: Int32
#   port out: warnings and errors
# ---------- colored_luminare: Python ----------
# Create Colored Luminaire

#Provided by Specularia 1.0
# Copyright 2023 Bryant Callahan, Mehlika Inanici, Ph.D. and Gundula Prosch (University of Washington) 
# Authored by Bryant Callahan & Dr. Mehlika Inanici 

# Adapated from Lark Spectral Lighting 
# (v0.0.1-v1.0 Mehlika Inanici, Ph.D.,University of Washington/Marty Brennan, ZGF Architects LLP; v2.0 Clotilde Pierson, Ph.D., EPFL, Oregon State University/ Myrta Gkaintatzi-Masouti, M.Sc., Eindhoven University of Technology.

# Licensed under The Modified 3-Clause BSD License (the "License");
# You may obtain a copy of the License at
# https://opensource.org/licenses/BSD-3-Clause

"""
Use this component to modifiy an existing rad file for a luminaire by adding the RGB color to it.

    Args:
        path: folder path of the existing luminaire rad file
        filename: filename of the existing luminaire rad file
        RGB_triplet: a list of 9 values that describe the spectral power distribution of the luminaire
        count: 0: blue part of the spectrum (first 3 of the 9 spectral values), 1: green part of the spectrum (second 3 of the 9 spectral values), 2: red part of the spectrum (last 3 of the 9 spectral values)
    Returns:
        file: modified filename (this is the same as the input file, the component modifies the existing and does not create a new)
"""

ghenv.Component.Name = "Create Colored Lumiaire"
ghenv.Component.NickName = 'Colored Luminare'
ghenv.Component.Message = 'Specularia v1.0'
ghenv.Component.Category = "Specularia"
ghenv.Component.SubCategory = "Lighting"

import re
import os


#check all inputs
error_list = []
inputs = [path, filename, RGB_triplet, count]
inputs_name = ["path", "filename", "RGB_triplet", "count"]

for idx, val in enumerate (inputs):
    if val == None or val == []:
        error_list.append(inputs_name[idx])

if len(error_list) != 0:
    check = "error"
else:
    check = 1

if check == "error":
    print "Warning! Connect the following inputs:" 
    print error_list

if filename == None:        
    filename = ""


#replace RGB triplet in electric light source file
if check != "error":
    
    #provide a directory with .rad file in folder
    _path = path
    if os.path.isdir(_path) != True: 
        os.makedirs(_path)
    else:
        pass
    os.chdir(_path)
    
    #print out current directory
    current_dir = _path
    
    #detect the triplet by choosing first and last value of one slice
    slice = [0,3],[3,6],[6,9]
    start = slice[count][0]
    end = slice[count][1]
    triplet = RGB_triplet[start:end]
    
    #substitue the RGB values
    substitute = 3,triplet[0],triplet[1],triplet[2]
    substitute = ' '.join(map(str, substitute))
    
    #define a regex function to write a new electric light source file
    def replace( filepath, subs, flags=0 ):
        with open( filepath, "r+" ) as file:
            fileContents = file.read()
            textPattern = re.compile(ur'3 1 1 1') #regex for Radiance default light
            fileContents = textPattern.sub( subs, fileContents ) #replace regex with subs 
            file.seek( 0 )
            file.truncate()
            file.write( fileContents )
    
    #write a new electric light source file
    file = filename + '.rad'
    replace (file, substitute)
    radfile = current_dir + file
    
    #print out the electric light source file
    print radfile
# ---------- end colored_luminare ----------

# ----
# 10c. Red channels
sky_filename_3 = Panel(specularia_spectral_sky.Sky_mat_9c)
iesluminairezone_3 = Honeybee_IESLuminaireZone(ptsList=pipeline, spin=spin_angle, tilt=tilt_angle, orientation=orientation_angle)  # -> readMe, luminaireZone; plug-in component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
concat_5 = Concatenate(Luminaire_type=panel_3, Root="red", JoinSeparator="_")
iescustomlamp_3 = Honeybee_IESCustomLamp(lampName=concat_5, rgbColors=ColourSwatch(SwatchColor=RGB(255, 255, 255)))  # -> readMe, lampDetails, customLamp; plug-in component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
concat_6 = Concatenate(Place="RadSimu", Root="red", Channel="9", JoinSeparator="_")
filter_11 = StreamFilter(Gate=light_source, Stream0=sky_filename_3, Stream1=gendarksky, Stream2=sky_filename_3)
iesluminaire_3 = Honeybee_IESLuminaire(
    iesFilePath=panel,
    luminaireZone=flatten(iesluminairezone_3.luminaireZone),
    lightLossFactor=llf,
    customLumName=concat_5,
    customLamp=iescustomlamp_3.customLamp,
    drawLuminaireWeb=light_distribution_toggle,
    radDir=electric_light_working_dir,
    writeRad=write_light_file_s)  # -> luminaireDetails, luminaireGeo, luminaireList, elecLightingData, radFilePath; plug-in component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
gridbasedsimulation_3 = Honeybee_GridBasedSimulation(
    skyFile=filter_11,
    testPoints=location,
    ptsVectors=direction,
    simulationType=simulation_type,
    radParameters=radparameters.radParameters)  # -> analysisRecipe; plug-in component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
createhbsrfs_5 = Honeybee_createHBSrfs(geometry=pipeline_2, RADMaterial=R_2)  # -> readMe, simplify(HBSurface); plug-in component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
createhbsrfs_6 = Honeybee_createHBSrfs(geometry=pipeline_3, RADMaterial=R)  # -> readMe, simplify(HBSurface); plug-in component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
filter_12 = StreamFilter(Gate=light_source, Stream1=iesluminaire_3.radFilePath, Stream2=iesluminaire_3.radFilePath)
split_3 = TextSplit(Text=iesluminaire_3.radFilePath, Separators="\")
item_17 = ListItem(List=split_3, Index=0, Wrap=True)
item_18 = ListItem(List=split_3, Index=1, Wrap=True)
item_19 = ListItem(List=split_3, Index=2, Wrap=True)
item_20 = ListItem(List=split_3, Index=3, Wrap=True)
concatenate_3 = Concatenate(Fragment_A=item_17, Fragment_B=item_18, Fragment_C=item_19, Fragment_D=item_20, JoinSeparator="\")
rundaylightanalysis_3 = Honeybee_RunDaylightSimulation(
    HBObjects=flatten([createhbsrfs_5.HBSurface, createhbsrfs_6.HBSurface]),
    analysisRecipe=gridbasedsimulation_3,
    writeRad=run_simulation,
    runRad=run_simulation,
    workingDir=working_directory,
    radFileName=concat_6,
    additionalRadFiles=flatten(filter_12),
    overwriteResults=True)  # -> out, analysisType, resultsUnit, results, illuminance_values, resultFiles, illuminance_files, studyFolder, done; plug-in component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
_2 = Integer(2)
colored_luminare_2 = CreateColoredLumiaire(path=concatenate_3, filename=concat_5, RGB_triplet=panel_11, count=_2)  # -> out, file; inputs RGB_triplet: list, count: Int32; same code as colored_luminare

# ----
# OUTPUT
# 9-Channel PAR (PPFD)
specularia_9_channel_par = Specularia9ChannelPAR(
    Irradiance1=rundaylightanalysis_2.resultFiles,
    Irradiance2=rundaylightanalysis.resultFiles,
    Irradiance3=rundaylightanalysis_3.resultFiles,
    RunPcomb=run_simulation)  # -> Current_dir, Par_output, Photopic_lux
colrange = LBColorRange(index=3)  # -> colors; plug-in component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
legendpar = LBLegendParameters(colors=colrange)  # -> leg_par; plug-in component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
par = Panel(specularia_9_channel_par.Par_output)
lux = Panel(specularia_9_channel_par.Photopic_lux)
heatmap = LBSpatialHeatmap(values=flatten(specularia_9_channel_par.Par_output), mesh=genmesh.mesh, legend_par=legendpar)  # -> mesh, legend, title, colors, legend_par; plug-in component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
tag = TextTag(Location=sensor_locations, Text=flatten(specularia_9_channel_par.Par_output))

# ==== cluster Cluster
custom = ClusterInput()
gate = ClusterInput()
_6500k = Text(["0.4298", "0.4332", "0.4366", "0.4399", "0.4433", "0.4467"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])
_9000k = Text(["0.5852", "0.5855", "0.5857", "0.586", "0.5863", "0.5865"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])
_5000k = Text(["0.234", "0.239", "0.245", "0.251", "0.256", "0.262"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])
custom_2 = Text(custom)
stream_filter = StreamFilter(Gate=gate, Stream0=_5000k, Stream1=_6500k, Stream2=_9000k, Stream3=custom_2)
ghpython_script = GhPythonScript(x="Specularia v1.0")  # -> a
# ---------- ghpython_script: Python ----------
d = ghenv.Component.OnPingDocument()
d.Owner.Message = str(x)
# ---------- end ghpython_script ----------
sky_spd = Text(stream_filter)
sky_spd_2 = ClusterOutput(sky_spd)
